# Grasshopper definition 01_PFS.gh (Grasshopper 1.0.8)

curve = Curve([<curve referenced from the Rhino model> x14])
point = Point(<point referenced from the Rhino model>)
point_2 = Point([<point referenced from the Rhino model> x4])
curve_2 = Curve([<curve referenced from the Rhino model> x3])
path_friendliness_score_original = Python3Script(boundary_crvs=curve_2, shelter_pts=point_2, obstacle_pts=point, window_crvs=curve)  # -> out, all_spheres, all_colors, scores; inputs boundary_crvs: list of Curve, shelter_pts: list of Point3d, obstacle_pts: list of Point3d, window_crvs: list of Curve
# ---------- path_friendliness_score_original: Python ----------
import Rhino.Geometry as geo
from System.Drawing import Color
import scriptcontext as sc
from typing import List
import ewha_utils
from ewha_utils.pfs import Corridor



# ---------- 실행부 ----------

# IN: boundary_crvs, shelter_pts, obstacle_pts, window_crvs
corridor_objects = []

for crv in boundary_crvs:
    corridor = Corridor(crv, boundary_crvs)
    corridor.calculate_scores(shelter_pts, obstacle_pts, window_crvs)
    corridor.visualize()
    corridor_objects.append(corridor)

# OUT
all_spheres = [sp for c in corridor_objects for sp in c.spheres]
all_colors = [clr for c in corridor_objects for clr in c.colors]
# ---------- end path_friendliness_score_original ----------
create_material = CreateMaterial(
    Diffuse=path_friendliness_score_original.all_colors,
    Specular=RGB(255, 255, 255),
    Emission=RGB(0, 0, 0),
    Transparency=0,
    Shine=0)
custom_preview = CustomPreview(Geometry=path_friendliness_score_original.all_spheres, Material=create_material)

point_3 = Point([<point referenced from the Rhino model> x3])
curve_3 = Curve([<curve referenced from the Rhino model> x25])
point_4 = Point([<point referenced from the Rhino model> x46])
curve_4 = Curve([<curve referenced from the Rhino model> x4])
path_friendliness_score_renovation = Python3Script(boundary_crvs=curve_4, shelter_pts=point_4, obstacle_pts=point_3, window_crvs=curve_3)  # -> out, all_spheres, all_colors, scores; inputs boundary_crvs: list of Curve, shelter_pts: list of Point3d, shelter_srfs: list of Surface, obstacle_pts: list of Point3d, window_crvs: list of Curve; same code as path_friendliness_score_original
create_material_2 = CreateMaterial(
    Diffuse=path_friendliness_score_renovation.all_colors,
    Specular=RGB(255, 255, 255),
    Emission=RGB(0, 0, 0),
    Transparency=0,
    Shine=0)
custom_preview_2 = CustomPreview(Geometry=path_friendliness_score_renovation.all_spheres, Material=create_material_2)

reloader = Python3Script(work=Button(), hard_mode=Toggle(True), package_name="ewha_utils")  # -> out, a; inputs hard_mode: Boolean, package_name: String
# ---------- reloader: Python ----------
import importlib
import sys
import scriptcontext as sc
import os
import types

def add_current_dir_to_sys_path():
    doc_path = sc.doc.Path
    if doc_path:
        dir_name = os.path.dirname(doc_path)
        parent_dir = os.path.dirname(dir_name)
        root_name = os.path.dirname(parent_dir)
        print(root_name)
        sys.path.append(root_name)
    else:
        return "Document has not been saved yet."

def reload_package(package):
    fn = package.__file__
    fn_dir = os.path.dirname(fn) + os.sep
    module_visit = {fn}
    
    def reload_recursive_ex(module):
        print(module)
        importlib.reload(module)
        for module_child in vars(module).values():
            if isinstance(module_child, types.ModuleType):
                fn_child = getattr(module_child, "__file__", None)
                if fn_child and fn_child.startswith(fn_dir) and fn_child not in module_visit:
                    module_visit.add(fn_child)
                    reload_recursive_ex(module_child)
    
    reload_recursive_ex(package)

def remove_modules(target_name):
    modules_to_remove = [m for m in sys.modules if target_name in m]
    for m in modules_to_remove:
        del sys.modules[m]
        print(f"{m} is deleted")

# 실행 코드

work = True

if work:
    add_current_dir_to_sys_path()
    if hard_mode:
        remove_modules(package_name)
    package = importlib.import_module(package_name)
    print(dir(package))
    reload_package(package)
# ---------- end reloader ----------
panel = Panel(reloader.out)
