# Grasshopper definition 2073004김정하.gh (Grasshopper 1.0.8)

# ----
# 시위 분류, 인원 기준으로 시각화하기
# 공격형 시위 시각화(색)
# 문화형 시위 시각화(색)
display = Python3Script()  # -> out, breps_aggressive, breps_cultural
# ---------- display: Python ----------
import scriptcontext as sc
import pandas as pd
import Rhino.Geometry as rg
import ewha_utils  # utils 모듈 안에 map_headcount_to_radius 함수가 정의되어 있어야 합니다
import os
# 엑셀 파일 경로
doc_path = sc.doc.Path
dir_name = os.path.dirname(doc_path)
dir_name = os.path.join(dir_name, "CSV")
file_name = "protest_final.csv"
file_path = os.path.join(dir_name, file_name)


# 옵션 토글 설정
aggressive_on = True
culture_on = True

# 결과 저장 리스트
breps_aggressive = []
breps_cultural = []


# pandas를 사용하여 엑셀 파일 읽기
df = pd.read_csv(file_path)

# 각 행에 대해 처리
for idx, row in df.iterrows():
    try:
        x = float(row['X'])
        y = float(row['Y'])
        z = float(row['Z'])
        kind = str(row.get('분류', '')).strip().replace("'", "").replace('"', '')
        name = str(row.get('시위명', '알 수 없음'))
        headcount_raw = row.get('인원', '')

        radius = ewha_utils.map_headcount_to_radius(headcount_raw)
        print(name + " → 반지름: " + str(radius))

        pt = rg.Point3d(x, y, z)
        circle = rg.Circle(pt, radius)
        curve = circle.ToNurbsCurve()
        planar_breps = rg.Brep.CreatePlanarBreps(curve)

        if not planar_breps:
            print(name + " - Brep 생성 실패")
            continue

        brep = planar_breps[0]

        if kind == "공격형":
            breps_aggressive.append(brep)
        elif kind == "문화형":
            breps_cultural.append(brep)
        elif kind == "" or kind is None:
            print(name + " - 분류 없음 → 제외됨")
        else:
            print(name + " - 알 수 없는 분류 '" + kind + "' → 제외됨")

    except Exception as e:
        print(name + " 오류:", str(e))
        continue

# 출력값
a = breps_aggressive  # 빨간색 프리뷰
b = breps_cultural     # 파란색 프리뷰
# ---------- end display ----------

# ----
# 배경 지도 shp 파일 가져오기
path = FilePath("C:\Users\jungha\Downloads\LARD_ADM_SECT_SGG_서울\LARD_ADM_SECT_SGG_11_202505.shp")
shp = ImportSHP(File=path)  # -> Points, Curves, Regions

preview = CustomPreview(Geometry=display.breps_cultural, Material=ColourSwatch(SwatchColor=RGB(56, 93, 255)))
preview_2 = CustomPreview(Geometry=display.breps_aggressive, Material=ColourSwatch(SwatchColor=RGB(255, 0, 0)))

reloader = Python3Script(work=Button(), hard_mode=Toggle(True), package_name="ewha_utils")  # -> out, a; inputs hard_mode: Boolean, package_name: String
# ---------- reloader: Python ----------
import importlib
import sys
import scriptcontext as sc
import os
import types

def add_current_dir_to_sys_path():
    doc_path = sc.doc.Path
    if doc_path:
        dir_name = os.path.dirname(doc_path)
        parent_dir = os.path.dirname(dir_name)
        root_name = os.path.dirname(parent_dir)
        print(root_name)
        sys.path.append(root_name)
    else:
        return "Document has not been saved yet."

def reload_package(package):
    fn = package.__file__
    fn_dir = os.path.dirname(fn) + os.sep
    module_visit = {fn}
    
    def reload_recursive_ex(module):
        print(module)
        importlib.reload(module)
        for module_child in vars(module).values():
            if isinstance(module_child, types.ModuleType):
                fn_child = getattr(module_child, "__file__", None)
                if fn_child and fn_child.startswith(fn_dir) and fn_child not in module_visit:
                    module_visit.add(fn_child)
                    reload_recursive_ex(module_child)
    
    reload_recursive_ex(package)

def remove_modules(target_name):
    modules_to_remove = [m for m in sys.modules if target_name in m]
    for m in modules_to_remove:
        del sys.modules[m]
        print(f"{m} is deleted")

# 실행 코드

work = True

if work:
    add_current_dir_to_sys_path()
    if hard_mode:
        remove_modules(package_name)
    package = importlib.import_module(package_name)
    print(dir(package))
    reload_package(package)
# ---------- end reloader ----------
panel = Panel(reloader.out)
