# Grasshopper definition CoralReef_SpaceSyntax.gh (Grasshopper 1.0.8)

crv = Curve(<curve referenced from the Rhino model>)
generate_coral_pts = Python3Script(lagoon_boundary=crv, count=Slider(100, range=0..100), artificial_coral_count=Slider(80, range=0..100))  # -> out, artificial_coral_points, real_coral_points; inputs lagoon_boundary: Curve, count: Int32, artificial_coral_count: Int32
# ---------- generate_coral_pts: Python ----------
import Rhino.Geometry as geo
import random
import ewha_utils

def generate_random_pts_in_boundary(boundary, count):
    """
    boundary: geo.Curve — 닫힌 planar curve
    count: int — 생성할 점 개수
    """
    if not boundary.IsClosed:
        raise ValueError("Boundary curve must be closed.")
    
    bbox = boundary.GetBoundingBox(True)
    points = []
    attempt = 0
    max_attempts = count * 100  # 무한 루프 방지
    z = boundary.PointAtStart.Z
    while len(points) < count and attempt < max_attempts:
        x = random.uniform(bbox.Min.X, bbox.Max.X)
        y = random.uniform(bbox.Min.Y, bbox.Max.Y)
        pt = geo.Point3d(x, y, z)  # z는 0으로 고정

        if ewha_utils.is_pt_inside(pt, boundary):
            points.append(pt)

        attempt += 1

    if len(points) < count:
        print("Warning: Could not generate enough points within the boundary.")

    return points


random_points = generate_random_pts_in_boundary(lagoon_boundary, count)
artificial_coral_points = random_points[:artificial_coral_count]
real_coral_points = [pt for pt in random_points if pt not in artificial_coral_points]
# ---------- end generate_coral_pts ----------
reloader = Python3Script(work=Button(), hard_mode=Toggle(True), package_name="ewha_utils")  # -> out, a; inputs hard_mode: Boolean, package_name: String
# ---------- reloader: Python ----------
import importlib
import sys
import scriptcontext as sc
import os
import types

def add_current_dir_to_sys_path():
    doc_path = sc.doc.Path
    if doc_path:
        dir_name = os.path.dirname(doc_path)
        parent_dir = os.path.dirname(dir_name)
        root_name = os.path.dirname(parent_dir)
        print(root_name)
        sys.path.append(root_name)
    else:
        return "Document has not been saved yet."

def reload_package(package):
    fn = package.__file__
    fn_dir = os.path.dirname(fn) + os.sep
    module_visit = {fn}
    
    def reload_recursive_ex(module):
        print(module)
        importlib.reload(module)
        for module_child in vars(module).values():
            if isinstance(module_child, types.ModuleType):
                fn_child = getattr(module_child, "__file__", None)
                if fn_child and fn_child.startswith(fn_dir) and fn_child not in module_visit:
                    module_visit.add(fn_child)
                    reload_recursive_ex(module_child)
    
    reload_recursive_ex(package)

def remove_modules(target_name):
    modules_to_remove = [m for m in sys.modules if target_name in m]
    for m in modules_to_remove:
        del sys.modules[m]
        print(f"{m} is deleted")

# 실행 코드

work = True

if work:
    add_current_dir_to_sys_path()
    if hard_mode:
        remove_modules(package_name)
    package = importlib.import_module(package_name)
    print(dir(package))
    reload_package(package)
# ---------- end reloader ----------
panel = Panel(reloader.out)

seed_coral = CustomPreview(Geometry=generate_coral_pts.real_coral_points, Material=ColourSwatch(SwatchColor=RGB(63, 159, 255)))  # disabled
artificial_coral = CustomPreview(Geometry=generate_coral_pts.artificial_coral_points, Material=ColourSwatch(SwatchColor=RGB(76, 13, 222)))  # disabled
distance_threshold = Slider(300000, range=0..1000000)
py3_b = Python3Script(
    is_artificial_added=Toggle(False),
    show_coral_geom=Toggle(True),
    artificial_pts=generate_coral_pts.artificial_coral_points,
    seed_pts=generate_coral_pts.real_coral_points,
    threshold=distance_threshold,
    GENERATION=Slider(3, range=0..3))  # -> out, alive_coral_pts, dead_coral_pts, all_coral_geoms; inputs show_coral_geom: Boolean, artificial_pts: list of Point3d, seed_pts: list of Point3d
# ---------- py3_b: Python ----------
import rhinoscriptsyntax as rs
import random
from typing import List
import Rhino
import Rhino.Geometry as geo
import ewha_utils

rhino_doc = Rhino.RhinoDoc.ActiveDoc



class Coral:
    def __init__(self, pt: geo.Point3d, gen: int = 0, is_dead = False):
        self.pt = pt
        self.gen = gen
        self.is_dead = is_dead

    def create_coral_geom(self):
        # 블록 이름은 gen1, gen2, gen3, gen4 이렇게 적혀 있다.
        # 블록의 geometry를 찾아서 거기에 geometry를 transform 해서 보낸다.
        gen_name = f"gen{self.gen}"
        gen_def = rhino_doc.InstanceDefinitions.Find(gen_name, True)
        
        if not gen_def:
            raise ValueError(f"Block definition '{gen_name}' not found.")

        geom_list = ewha_utils.geom_dict_to_list(
            ewha_utils.get_geoms_from_block_definition(rhino_doc, gen_def)
        )

        transform = geo.Transform.Translation(geo.Vector3d(self.pt))
        for geom in geom_list:
            geom.Transform(transform)
        return geom_list

    def resurrect(self):
        if not self.is_dead:
            raise ValueError("its not dead")
        self.is_dead = False
        self.gen = 1

    def die(self):
        if self.is_dead:
            raise ValueError("its dead already")
        self.is_dead = True
        self.gen = 0

class CoralPlacer:
    def __init__(self, artificial_pts, seed_pts):
        # 모든 artificial coral은 처음엔 죽은 상태
        self.dead_corals = [Coral(pt, is_dead=True) for pt in artificial_pts.copy()]

        # 초기 생존 seed 판단
        self.alive_corals = [Coral(pt, gen=1) for pt in seed_pts.copy()]
        self.death_ratio = 0.03

    def process_1_generation(self):
        # 세대 증가
        for coral in self.alive_corals:
            coral.gen += 1

        self._process_coral_dying_1_generation()
        self._process_coral_resurrect_1_generation()

    def _process_coral_resurrect_1_generation(self):
        # 근처에 살아있는 coral이 있다면 부활
        resurrected = []
        for coral in self.dead_corals:
            if any(coral.pt.DistanceTo(seed.pt) <= threshold for seed in self.alive_corals):
                coral.resurrect()
                resurrected.append(coral)

        for r in resurrected:
            self.alive_corals.append(r)
            self.dead_corals.remove(r)
    
    def _process_coral_dying_1_generation(self):
        # 일정 비율 죽음 (최소 1개)
        death_count = max(1, int(len(self.alive_corals) * self.death_ratio))
        dying_coral_pts = random.sample(self.alive_corals, min(death_count, len(self.alive_corals)))
        for dying_coral_pt in dying_coral_pts:
            dying_coral_pt.die()
            self.alive_corals.remove(dying_coral_pt)
            self.dead_corals.append(dying_coral_pt)
        
    def get_coral_geoms(self) -> List[geo.GeometryBase]:
        """
        지정한 위치에 해당 generation의 coral block을 이동시킨 geometry 반환
        """
        all_coral_geoms = []
        for coral_pt in self.alive_corals:
            geoms = coral_pt.create_coral_geom()
            all_coral_geoms += geoms
        return all_coral_geoms
    
    @property
    def alive_coral_pts(self):
        
        return [coral.pt for coral in self.alive_corals]

    @property
    def dead_coral_pts(self):
        return [coral.pt for coral in self.dead_corals]
        
if not is_artificial_added:
    artificial_pts = []
coral_placer = CoralPlacer(artificial_pts, seed_pts)

# Generation 반복
for _ in range(int(GENERATION)):
    coral_placer.process_1_generation()


alive_coral_pts = coral_placer.alive_coral_pts
dead_coral_pts = coral_placer.dead_coral_pts
if show_coral_geom:
    all_coral_geoms = coral_placer.get_coral_geoms()
# ---------- end py3_b ----------
preview = CustomPreview(Geometry=flatten(py3_b.alive_coral_pts), Material=ColourSwatch(SwatchColor=RGB(0, 201, 49)))

preview_2 = CustomPreview(Geometry=flatten(py3_b.dead_coral_pts), Material=ColourSwatch(SwatchColor=RGB(201, 0, 0)))
