# Grasshopper definition 공구분_프로젝트.gh (Grasshopper 1.0.8)

reloader = Python3Script(work=Button(), hard_mode=Toggle(True), package_name="ewha_utils")  # -> out, a; inputs hard_mode: Boolean, package_name: String
# ---------- reloader: Python ----------
import importlib
import sys
import scriptcontext as sc
import os
import types

def add_current_dir_to_sys_path():
    doc_path = sc.doc.Path
    if doc_path:
        dir_name = os.path.dirname(doc_path)
        parent_dir = os.path.dirname(dir_name)
        root_name = os.path.dirname(parent_dir)
        print(root_name)
        sys.path.append(root_name)
    else:
        return "Document has not been saved yet."

def reload_package(package):
    fn = package.__file__
    fn_dir = os.path.dirname(fn) + os.sep
    module_visit = {fn}
    
    def reload_recursive_ex(module):
        print(module)
        importlib.reload(module)
        for module_child in vars(module).values():
            if isinstance(module_child, types.ModuleType):
                fn_child = getattr(module_child, "__file__", None)
                if fn_child and fn_child.startswith(fn_dir) and fn_child not in module_visit:
                    module_visit.add(fn_child)
                    reload_recursive_ex(module_child)
    
    reload_recursive_ex(package)

def remove_modules(target_name):
    modules_to_remove = [m for m in sys.modules if target_name in m]
    for m in modules_to_remove:
        del sys.modules[m]
        print(f"{m} is deleted")

# 실행 코드

work = True

if work:
    add_current_dir_to_sys_path()
    if hard_mode:
        remove_modules(package_name)
    package = importlib.import_module(package_name)
    print(dir(package))
    reload_package(package)
# ---------- end reloader ----------
crv = Curve(<curve referenced from the Rhino model>)
srf = Surface(<surface referenced from the Rhino model>)
crv_2 = Curve(<curve referenced from the Rhino model>)
brep = Brep([<brep referenced from the Rhino model> x3839])
brep_2 = Brep([<brep referenced from the Rhino model> x603])
panel = Panel(reloader.out)
py3 = Python3Script(
    activate=Toggle(False),
    bake=Toggle(False),
    center_crv=crv,
    boundary_srf=srf,
    boundary_crv=crv_2,
    obstacles=[brep, brep_2],
    sample_dist=Slider(3000, range=0..100000))  # -> out, points, widths, obstacle_flags, types, text_points, text_values, road_circles, colors, road_surfaces; inputs activate: Boolean, bake: Boolean, center_crv: Curve, boundary_srf: Surface, boundary_crv: Curve, obstacles: list of Brep
# ---------- py3: Python ----------
import Rhino
import Rhino.Geometry as geo
import scriptcontext as sc
import System

# 중심 커브에서 주어진 파라미터 t에서 3D 위치, 평면 투영 위치, 수직 벡터를 계산
def get_frame(center_crv, t):
    pt_3d = center_crv.PointAt(t)
    tan_vec = center_crv.TangentAt(t)
    tan_vec.Unitize()
    perp_vec = geo.Vector3d(-tan_vec.Y, tan_vec.X, 0)  # 수직 벡터
    perp_vec.Unitize()
    pt_flat = geo.Point3d(pt_3d.X, pt_3d.Y, 0)
    return pt_3d, pt_flat, perp_vec

# 수직선 방향으로 boundary 커브와의 교차점을 찾아 도로폭 계산
def compute_road_width(pt_flat, perp_vec, boundary_crv):
    line_l = geo.LineCurve(pt_flat, pt_flat - perp_vec * 15000)
    line_r = geo.LineCurve(pt_flat, pt_flat + perp_vec * 15000)
    inter_l = geo.Intersect.Intersection.CurveCurve(line_l, boundary_crv, 0.01, 0.01)
    inter_r = geo.Intersect.Intersection.CurveCurve(line_r, boundary_crv, 0.01, 0.01)

    if inter_l and inter_r and len(inter_l) > 0 and len(inter_r) > 0:
        p1 = inter_l[0].PointA
        p2 = inter_r[0].PointA
        return p1.DistanceTo(p2), p1, p2
    return None, None, None

# 장애물과의 충돌 여부 체크 (양 방향으로 raycast)
def check_obstacles(pt, perp_vec, obstacles, dist=20000):
    ray_l = geo.LineCurve(pt, pt - perp_vec * dist)
    ray_r = geo.LineCurve(pt, pt + perp_vec * dist)

    hit_l = any(geo.Intersect.Intersection.CurveBrep(ray_l, obs, 0.01)[2] for obs in obstacles)
    hit_r = any(geo.Intersect.Intersection.CurveBrep(ray_r, obs, 0.01)[2] for obs in obstacles)
    return hit_l, hit_r

# 도로폭과 장애물 여부에 따라 타입 결정
def determine_type(road_width, hit_l, hit_r):
    if road_width is None:
        return None
    elif road_width < 3000:
        return 4
    elif 3000 <= road_width <= 5000:
        return 1 if (hit_l or hit_r) else None
    elif road_width > 5000:
        return 3 if (hit_l and hit_r) else 2
    return None

# 시각화용 원 및 planar surface 생성
def create_road_visuals(pt, road_width):
    radius = (road_width or 1000) / 2.0
    circle = geo.Circle(geo.Plane(pt, geo.Vector3d.ZAxis), radius)
    circle_crv = circle.ToNurbsCurve()
    breps = geo.Brep.CreatePlanarBreps(circle_crv)
    return circle, breps[0] if breps else None

# 메인 실행 블록
if activate:
    # 필수 입력 체크
    if not center_crv or not boundary_srf or not sample_dist:
        raise ValueError("center_crv, boundary_srf, sample_dist는 필수 입력입니다.")

    # 디버깅/오류 정보 저장용
    sc.sticky["error"] = []

    # 결과 저장 리스트 초기화
    points, widths, obstacle_flags, types = [], [], [], []
    left_pts, right_pts, text_points, text_values = [], [], [], []
    road_circles, road_surfaces = [], []

    # 커브 길이에 따른 샘플링 포인트 수 계산
    curve_length = center_crv.GetLength()
    num_points = max(1, int(curve_length / sample_dist))
    t_vals = [center_crv.Domain.ParameterAt(i / float(num_points)) for i in range(num_points + 1)]

    # 각 샘플링 지점에 대해 분석 수행
    for t in t_vals:
        # 중심점 및 수직 벡터 구하기
        pt_3d, pt_flat, perp_vec = get_frame(center_crv, t)

        # 도로폭 계산
        road_width, p1, p2 = compute_road_width(pt_flat, perp_vec, boundary_crv)
        widths.append(road_width)
        if road_width:
            sc.sticky["error"].append((p1, p2, road_width))

        # 장애물 체크
        hit_l, hit_r = check_obstacles(pt_3d, perp_vec, obstacles)
        obstacle_flags.append((hit_l, hit_r))

        # 도로 타입 판정
        type_val = determine_type(road_width, hit_l, hit_r)
        types.append(type_val)
        points.append(pt_3d)

        # 좌우 끝점 계산
        offset = (road_width or 0) / 2
        left_pts.append(pt_3d + perp_vec * offset)
        right_pts.append(pt_3d - perp_vec * offset)

        # 텍스트 표시용
        text_points.append(pt_3d)
        text_values.append(str(type_val) if type_val is not None else "None")

        # 시각화용 원 및 서피스 생성
        circle, brep = create_road_visuals(pt_3d, road_width)
        road_circles.append(circle)
        road_surfaces.append(brep)

    # 회색조 색상 계산 (도로폭 기반)
    valid_widths = [w for w in widths if w and w > 0]
    min_width = min(valid_widths) * 0.95 if valid_widths else 0
    max_width = max(valid_widths) if valid_widths else 1
    range_width = max(max_width - min_width, 1e-3)

    colors = []
    for w in widths:
        if not w or w <= min_width:
            gray_val = 30
        else:
            w_norm = (w - min_width) / range_width
            gray_val = int(w_norm * 200) + 30
        gray_val = max(30, min(gray_val, 230))

        # Rhino 색상 객체 생성
        color = Rhino.Display.ColorRGBA(gray_val, gray_val, gray_val, 255).ToArgb()
        colors.append(color)

    # 결과를 Rhino 뷰포트에 배치 (Bake)
    if bake:
        added_obj_ids = []
        for brep, clr in zip(road_surfaces, colors):
            if brep:
                obj_id = sc.doc.Objects.AddBrep(brep)
                if obj_id != System.Guid.Empty:
                    obj = sc.doc.Objects.Find(obj_id)
                    attrs = obj.Attributes
                    attrs.ObjectColor = clr
                    attrs.ColorSource = Rhino.DocObjects.ObjectColorSource.ColorFromObject
                    obj.CommitChanges()
                    added_obj_ids.append(obj_id)

        # 뷰포트 새로고침
        sc.doc.Views.Redraw()
# ---------- end py3 ----------

# ---- group: POINT CHECK
number_slider = Slider(94, range=0..100)
item = ListItem(List=py3.types, Index=number_slider, Wrap=True)
item_2 = ListItem(List=py3.points, Index=number_slider, Wrap=item)
pt = Point(item_2)
panel_2 = Panel(item)

# ----
tag = TextTag3D(Location=py3.text_points, Text=py3.text_values, Size=Slider(1000, range=0..1000), Justification=7)
preview = CustomPreview(Geometry=py3.road_surfaces, Material=py3.colors)
