# Grasshopper definition ABS_simulation.gh (Grasshopper 1.0.8)
# plug-ins: Fologram for Grasshopper

augdoc = AugmentedDocument(augmented_trigger_0_key=button, num_augmented_triggers=1)
trigger = Trigger(Interval=10, TimerInterval=10, Target=rec)  # disabled
rec = DataRecorder(Slider(0, range=0..100), DataLimit=-10, RecordData=True)  # disabled
button = Button()
lng = ListLength(List=rec)
tourist_start_point = Point(<point referenced from the Rhino model>)
walls = Curve([<curve referenced from the Rhino model> x9])
touristing_points = Point([<point referenced from the Rhino model> x5])
ritual_start_point = Point(<point referenced from the Rhino model>)
ritual_goals = Point([<point referenced from the Rhino model> x2])
reloader = Python3Script(work=Button(), hard_mode=Toggle(True), package_name="ewha_utils")  # -> out, a; inputs hard_mode: Boolean, package_name: String
# ---------- reloader: Python ----------
import importlib
import sys
import scriptcontext as sc
import os
import types

def add_current_dir_to_sys_path():
    doc_path = sc.doc.Path
    if doc_path:
        dir_name = os.path.dirname(doc_path)
        parent_dir = os.path.dirname(dir_name)
        root_name = os.path.dirname(parent_dir)
        print(root_name)
        sys.path.append(root_name)
    else:
        return "Document has not been saved yet."

def reload_package(package):
    fn = package.__file__
    fn_dir = os.path.dirname(fn) + os.sep
    module_visit = {fn}
    
    def reload_recursive_ex(module):
        print(module)
        importlib.reload(module)
        for module_child in vars(module).values():
            if isinstance(module_child, types.ModuleType):
                fn_child = getattr(module_child, "__file__", None)
                if fn_child and fn_child.startswith(fn_dir) and fn_child not in module_visit:
                    module_visit.add(fn_child)
                    reload_recursive_ex(module_child)
    
    reload_recursive_ex(package)

def remove_modules(target_name):
    modules_to_remove = [m for m in sys.modules if target_name in m]
    for m in modules_to_remove:
        del sys.modules[m]
        print(f"{m} is deleted")

# 실행 코드

work = True

if work:
    add_current_dir_to_sys_path()
    if hard_mode:
        remove_modules(package_name)
    package = importlib.import_module(package_name)
    print(dir(package))
    reload_package(package)
# ---------- end reloader ----------
# 1.전체 동선 이미지
tourist_start_point_2 = Point(<point referenced from the Rhino model>)
walls_2 = Curve([<curve referenced from the Rhino model> x12])
touristing_points_2 = Point([<point referenced from the Rhino model> x4])
# 2.시뮬레이션 영상
ritual_goals_2 = Point([<point referenced from the Rhino model> x5])
simulation = Python3Script(
    reset=button,
    trigger=lng,
    tourist_start_point=tourist_start_point,
    walls=walls,
    touristing_points=touristing_points,
    ritual_start_point=ritual_start_point,
    ritual_goals=ritual_goals)  # -> out, agent_tourist_shapes, agent_ritual_shapes; inputs reset: Boolean, tourist_start_point: Point3d, walls: list of Curve, touristing_points: list of Point3d, ritual_start_point: Point3d, ritual_goals: list of Point3d
# ---------- simulation: Python ----------
# import utils 패키지에서 path_utils, agents 를 불러오기
import Rhino.Geometry as rg
import random
import ewha_utils
import ewha_utils.agents as agents

# reset
if reset and ('agents1' in globals() or 'agents2' in globals()):
    if 'agents1' in globals(): del agents1
    if 'agents2' in globals(): del agents2

# 에이전트 리스트 생성
if 'agents1' not in globals():
    agents1 = []
if 'agents2' not in globals():
    agents2 = []

# trigger (시간 흐름 → 값이 증가할 때마다 업데이트)
try:
    trigger_safe = int(trigger)
except:
    trigger_safe = 0

# 제관 에이전트 추가
if trigger_safe % 50 == 0 and len(agents2) < 50:
    goals_list = ritual_goals if isinstance(ritual_goals, list) else [ritual_goals]
    agents2.append(agents.RitualAgent(ritual_start_point, goals_list, speed=5000.0))

# ritual_paths 생성 (Polyline → Curve 변환)
ritual_paths = [rg.Polyline(agent.path).ToNurbsCurve() for agent in agents2 if hasattr(agent, 'path') and agent.path]

# 방문자 에이전트 추가
if trigger_safe % 50 == 0 and len(agents1) < 50:
    v = random.uniform(4000, 6000)
    agents1.append(agents.TouristAgent(tourist_start_point, v, walls, touristing_points, ritual_paths))

# 에이전트 업데이트 (한 스텝씩 이동)
ritual_positions = [agent.current_position for agent in agents2 if not agent.finished]
for agent in agents1:
    agent.update(ritual_positions)
for agent in agents2:
    agent.update()

# 출력
agent_tourist_shapes = [ewha_utils.make_circle(agent.current_position) for agent in agents1 if not agent.finished and agent.current_position]
agent_ritual_shapes = [ewha_utils.make_circle(agent.current_position) for agent in agents2 if not agent.finished and agent.current_position]
# ---------- end simulation ----------
circulation = Python3Script(
    tourist_start_point=tourist_start_point_2,
    walls=walls_2,
    touristing_points=touristing_points_2,
    ritual_goals=ritual_goals_2)  # -> tourist_paths, ritual_path; inputs tourist_start_point: Point3d, walls: list of Curve, touristing_points: list of Point3d, ritual_goals: list of Point3d
# ---------- circulation: Python ----------
# import utils 패키지에서 path_utils 를 불러오기
import ewha_utils

# 제관 공통 경로 만들기
ritual_path = ewha_utils.create_ritual_path(ritual_goals)

# 방문자 경로 50명 만들기
tourist_paths = []
for _ in range(50):
    ritual_path_list = [ritual_path] if ritual_path is not None else []
    curve = ewha_utils.get_tourist_path(tourist_start_point, walls, touristing_points, ritual_path_list)
    if curve:
        tourist_paths.append(curve)
# ---------- end circulation ----------
panel = Panel(reloader.out)
panel_2 = Panel(simulation.out)
crv = Curve(simulation.agent_ritual_shapes)
crv_2 = Curve(simulation.agent_tourist_shapes)
tourist_preview_1 = CustomPreview(Geometry=circulation.tourist_paths, Material=ColourSwatch(SwatchColor=RGB(0, 85, 255)))
ritual_preview_1 = CustomPreview(Geometry=circulation.ritual_path, Material=ColourSwatch(SwatchColor=RGB(255, 0, 0)))
tourist_preview_2 = CustomPreview(Geometry=crv_2, Material=ColourSwatch(SwatchColor=RGB(0, 85, 255)))
ritual_preview_2 = CustomPreview(Geometry=crv, Material=ColourSwatch(SwatchColor=RGB(255, 0, 0)))
