# Grasshopper definition CO2 Panel.gh (Grasshopper 1.0.8)

reloader = Python3Script(work=Button(), hard_mode=Toggle(True), package_name="ewha_utils")  # -> out, a; inputs hard_mode: Boolean, package_name: String
# ---------- reloader: Python ----------
import importlib
import sys
import scriptcontext as sc
import os
import types

def add_current_dir_to_sys_path():
    doc_path = sc.doc.Path
    if doc_path:
        dir_name = os.path.dirname(doc_path)
        parent_dir = os.path.dirname(dir_name)
        root_name = os.path.dirname(parent_dir)
        print(root_name)
        sys.path.append(root_name)
    else:
        return "Document has not been saved yet."

def reload_package(package):
    fn = package.__file__
    fn_dir = os.path.dirname(fn) + os.sep
    module_visit = {fn}
    
    def reload_recursive_ex(module):
        print(module)
        importlib.reload(module)
        for module_child in vars(module).values():
            if isinstance(module_child, types.ModuleType):
                fn_child = getattr(module_child, "__file__", None)
                if fn_child and fn_child.startswith(fn_dir) and fn_child not in module_visit:
                    module_visit.add(fn_child)
                    reload_recursive_ex(module_child)
    
    reload_recursive_ex(package)

def remove_modules(target_name):
    modules_to_remove = [m for m in sys.modules if target_name in m]
    for m in modules_to_remove:
        del sys.modules[m]
        print(f"{m} is deleted")

# 실행 코드

work = True

if work:
    add_current_dir_to_sys_path()
    if hard_mode:
        remove_modules(package_name)
    package = importlib.import_module(package_name)
    print(dir(package))
    reload_package(package)
# ---------- end reloader ----------
panel = Panel(reloader.out)

# ---- group: CO2
step = Slider(1500, range=0..10000)
brep = Brep(<brep referenced from the Rhino model>)
co2_space = Python3Script(co2_check_space=brep, step=step)  # -> out, co2_points, co2_levels; inputs co2_check_space: Brep, step: Int32
# ---------- co2_space: Python ----------
import random
import Rhino.Geometry as geo
import scriptcontext as sc
import ewha_utils

# CO2 대기 공간의 BoundingBox 계산
bbox = co2_check_space.GetBoundingBox(True) 

# BoundingBox 내에서 일정 간격으로 점 생성
co2_points = ewha_utils.get_points_in_bbox(bbox, step)

# 각 점에 대해 무작위 CO2 농도값 생성(400~1000ppm 범위)
co2_levels = ewha_utils.generate_co2_levels(len(co2_points))
# ---------- end co2_space ----------
trigger = Trigger(Interval=1000, TimerInterval=1000, Target=time_move_co2)  # disabled
mesh = Mesh(<mesh referenced from the Rhino model>)
time_move_co2 = Python3Script(step=step, reset=Button(), co2_points=co2_space.co2_points, co2_levels=co2_space.co2_levels, co2=mesh)  # -> out, moved_points, moved_levels, instances; inputs step: Int32, reset: Int32, co2_points: list of Point3d, co2_levels: list of Double, co2: Mesh
# ---------- time_move_co2: Python ----------
import time
import copy
import scriptcontext as sc
import Rhino.Geometry as geo
import Rhino

MAX_TIME_STEP = 15
INTERVAL_SEC = 1.0

def update_time_step(sc, reset, max_step=MAX_TIME_STEP, interval=INTERVAL_SEC):
    """sticky를 이용한 시간 기반 step 업데이트"""
    if "time_step" not in sc.sticky:
        sc.sticky["time_step"] = 0
    if "last_update_time" not in sc.sticky:
        sc.sticky["last_update_time"] = 0.0

    current_time = time.time()

    if reset:
        sc.sticky["time_step"] = 0
        sc.sticky["last_update_time"] = current_time
    else:
        if current_time - sc.sticky["last_update_time"] >= interval:
            if sc.sticky["time_step"] < max_step:
                sc.sticky["time_step"] += 1
            sc.sticky["last_update_time"] = current_time
    return sc.sticky["time_step"]

time_step = update_time_step(sc, reset)

def move_points(points, time_step, step_size):
    """시간에 따라 X 방향으로 이동한 포인트 리스트 생성"""
    return [geo.Point3d(pt.X + time_step * step_size, pt.Y, pt.Z) for pt in points]

moved_points = move_points(co2_points, time_step, step)

def shift_co2_levels(levels, shift_count):
    """CO2 레벨을 시간 기준으로 밀어내기 (앞 제거, 뒤에 0 추가)"""
    if shift_count < len(levels):
        return levels[shift_count:] + [0.0] * shift_count
    else:
        return [0.0] * len(levels)

moved_levels = shift_co2_levels(co2_levels, time_step)


def normalize(values, min_val=400, max_val=1000):
    """CO2 농도 정규화"""
    normed = []
    for v in values:
        norm = (v - min_val) / float(max_val - min_val)
        normed.append(norm)
    return normed

moved_levels_normalized = normalize(moved_levels)

def generate_scaled_instances(co2_mesh, moved_points, moved_levels_normalized, min_scale=0.5, max_scale=2.5):
    """CO2 값에 따라 스케일 조정 및 위치 이동된 mesh 인스턴스들을 생성"""
    
    instances = []

    for pt, norm in zip(moved_points, moved_levels_normalized):
        # mesh 복사
        instance = co2_mesh.Duplicate()

        # 원점 기준 이동 벡터 계산
        brep_bbox = instance.GetBoundingBox(True)
        brep_center = brep_bbox.Center
        move_to_origin = geo.Transform.Translation(-brep_center.X, -brep_center.Y, -brep_center.Z)
        instance.Transform(move_to_origin)

        # 스케일 변환
        scale_factor = min_scale + (max_scale - min_scale) * norm
        scale_transform = geo.Transform.Scale(geo.Point3d.Origin, scale_factor)
        instance.Transform(scale_transform)

        # 원하는 위치로 이동
        move_to_point = geo.Transform.Translation(pt.X, pt.Y, pt.Z)
        instance.Transform(move_to_point)
        instances.append(instance)

    return instances

instances = generate_scaled_instances(co2, moved_points, moved_levels_normalized)
# ---------- end time_move_co2 ----------
preview = CustomPreview(Geometry=time_move_co2.instances, Material=ColourSwatch(SwatchColor=RGBA(195, 75, 255, 200)))

# ---- group: PANEL
srf = Surface([<surface referenced from the Rhino model> x8])
panel_group = Python3Script(moved_points=time_move_co2.moved_points, moved_levels=time_move_co2.moved_levels, panel_surfaces=srf)  # -> out, total_active_panels, total_inactive_panels; inputs moved_points: list of Point3d, moved_levels: list of Double, panel_surfaces: list of Surface
# ---------- panel_group: Python ----------
import Rhino.Geometry as geo 
import random
import ghpythonlib.treehelpers as th
import ewha_utils
import scriptcontext as sc


def get_panel_group_performance(moved_levels):
    """CO2 농도에 따른 패널 작동 비율 반환 (0.0 ~ 1.0)"""
    if 400 <= moved_levels < 500:
        return 0.0
    elif 500 <= moved_levels < 600:
        return 0.25
    elif 600 <= moved_levels < 700:
        return 0.5
    elif 700 <= moved_levels < 800:
        return 0.75
    elif 800 <= moved_levels < 900:
        return 1.0
    else:
        return 1.0  # 범위 밖은 작동 안함

class PanelGroup:
    """개별 패널이 여러개 모인 Surface 그룹을 CO₂ 농도 값에 따라 제어하는 클래스"""

    def __init__(self, panel_srf, co2_value, u_num, v_num):
        """패널 그룹 초기화 및 패널 분할"""
        self.panel_srf = panel_srf 
        self.co2_value = co2_value
        self.panels = ewha_utils.divide_srf(panel_srf, u_num, v_num)
        self.ratio = get_panel_group_performance(co2_value)
        self.active_count = int(self.ratio * len(self.panels))
        if self.active_count < 0 : 
            raise ValueError

    def evaluate_panels(self):
        """패널 중 일부를 활성패널로 랜덤 선택하고 나머지를 비활성으로 구분"""
        active_panels = random.sample(self.panels, self.active_count)
        inactive_panels = [panel for panel in self.panels if panel not in active_panels] 
        
        return active_panels, inactive_panels
        
    def print_message(self):
        """현재 패널 그룹의 CO2값 및 작동 비율 정보 출력"""
        print(f"CO2 {self.co2_value:.2f}, ratio {self.ratio}")
        print(f"total panels :{len(self.panels)}, active count : {self.active_count}")


def get_closest_pt(panel_group, point_list):
    """패널그룹에서 가장 가까운 포인트 찾기"""
    closest = None
    min_dist = float('inf')
    panel_group_center = panel_group.GetBoundingBox(True).Center #패널그룹의 센터

    for pt in point_list: #모든 점을 반복하며 가장 가까운 점을 찾는다.
        dist = panel_group_center.DistanceTo(pt)
        if dist < min_dist:
            min_dist = dist
            closest = pt
    return closest


def get_co2_avg_value(panel_surface):
    """가장 가까운 점들의 co2평균 농도 구하기"""
    closest_pt = get_closest_pt(panel_surface, moved_points)
    closest_dist = ewha_utils.get_dist_srf_to_pt(panel_surface, closest_pt)    
    points_to_concern = [pt for pt in moved_points if ewha_utils.get_dist_srf_to_pt(panel_surface, pt)<closest_dist + 1] 
    co2_values = [] 
    for point in points_to_concern:
        index = moved_points.index(point)
        co2_value = moved_levels[index]
        co2_values.append(co2_value)
    
    return sum(co2_values)/ len(co2_values)

# 각 패널 그룹
total_panel_groups = [] 
total_active_panels = [] 
total_inactive_panels = []

#각 그룹에 대해 처리
u_num = 10
v_num = 10

for panel_surface in panel_surfaces:
    # 일정 거리 안의 포인트들의 이산화탄소 값의 평균을 구해서 RATIO산정
    co2_value = get_co2_avg_value(panel_surface)
    
    #PanelGroup 생성, Panel 그룹 내부에서 Panel 분절하고, co2 value에 따라 작동하는 패널도 결정된다.
    panel_group = PanelGroup(panel_surface, co2_value, u_num, v_num)
    active_panels, inactive_panels = panel_group.evaluate_panels()    
    
    # 전체 리스트에 취합
    total_panel_groups.append(panel_group)
    total_active_panels += active_panels
    total_inactive_panels += inactive_panels


for group in total_panel_groups:
    group.print_message()
# ---------- end panel_group ----------
srf_2 = Surface(panel_group.total_active_panels)
srf_3 = Surface(panel_group.total_inactive_panels)
preview_2 = CustomPreview(Geometry=srf_2, Material=ColourSwatch(SwatchColor=RGBA(0, 158, 191, 200)))
preview_3 = CustomPreview(Geometry=srf_3, Material=ColourSwatch(SwatchColor=RGBA(255, 255, 255, 200)))
