# Grasshopper definition safety test.gh (Grasshopper 1.0.8)

pt = Point([<point referenced from the Rhino model> x704])
pt_2 = Point([<point referenced from the Rhino model> x6])
pt_3 = Point(<point referenced from the Rhino model>)
crv = Curve([<curve referenced from the Rhino model> x19])
map = Python3Script()  # -> building_curves, road_curves, sidewalk_curves
# ---------- map: Python ----------
import json
import Rhino.Geometry as geo

# 기준점 (서울 구로구 오류동 근방)
origin_lon = 126.833
origin_lat = 37.492

# 위도/경도 → 평면좌표 변환 함수
def latlon_to_local(x, y):
    dx = (x - origin_lon) * 88000
    dy = (y - origin_lat) * 111000
    return geo.Point3d(dx, dy, 0)

# 함수: GeoJSON 하나 읽어서 curve 리스트 반환
def load_geojson_curves(file_path):
    curves = []
    with open(file_path, encoding='utf-8') as f:
        geojson_data = json.load(f)

    for feature in geojson_data['features']:
        geom_type = feature['geometry']['type']
        coords = feature['geometry']['coordinates']

        if geom_type == 'Polygon':
            for ring in coords:
                pts = [latlon_to_local(x, y) for x, y in ring]
                if len(pts) > 1:
                    curves.append(geo.Polyline(pts).ToNurbsCurve())

        elif geom_type == 'MultiPolygon':
            for polygon in coords:
                for ring in polygon:
                    pts = [latlon_to_local(x, y) for x, y in ring]
                    if len(pts) > 1:
                        curves.append(geo.Polyline(pts).ToNurbsCurve())
    return curves

import scriptcontext as sc
import os


directory_name = os.path.dirname(sc.doc.Path)
geojson_folder_name = os.path.join(directory_name, "geojson")
building_file_path = os.path.join(geojson_folder_name, "map_building.geojson")
road_file_path = os.path.join(geojson_folder_name, "map_road.geojson")
sidewalk_file_path = os.path.join(geojson_folder_name, "map_sidewalk.geojson")
# 각 파일 처리
building_curves = load_geojson_curves(building_file_path)
road_curves     = load_geojson_curves(road_file_path)
sidewalk_curves = load_geojson_curves(sidewalk_file_path)
# ---------- end map ----------
py3 = Python3Script(path_crv=crv, step=Slider(10, range=0..100))  # -> path_points; inputs path_crv: Curve
# ---------- py3: Python ----------
import Rhino.Geometry as geo

# 입력: path_crv (경로 Curve), step (간격)
# 출력: path_points (경로를 일정 간격으로 나눈 점 리스트)

def divide_curve(crv, step):
    crv_length = crv.GetLength()
    count = int(crv_length // step)
    params = [crv.Domain.ParameterAt(i / float(count)) for i in range(count + 1)]
    points = [crv.PointAt(t) for t in params]
    return points

path_points = divide_curve(path_crv, step)
# ---------- end py3 ----------
cctv_point = Python3Script()  # -> cctv_points
# ---------- cctv_point: Python ----------
import json
import Rhino.Geometry as geo

# 지도 기준점 (오류동 중심) -> 지역에 맞게 변형 가능
origin_lon = 126.833
origin_lat = 37.492

# 위도·경도 → Rhino 평면좌표
def latlon_to_local(lon, lat):
    dx = (lon - origin_lon) * 88000
    dy = (lat - origin_lat) * 111000
    return geo.Point3d(dx, dy, 0)

import scriptcontext as sc
import os


directory_name = os.path.dirname(sc.doc.Path)
geojson_folder_name = os.path.join(directory_name, "geojson")
file_path = os.path.join(geojson_folder_name, "cctv_for_rhino.json")


with open(file_path, encoding='utf-8') as f:
    cctv_data = json.load(f)

cctv_points = []
cctv_texts = []

for item in cctv_data:
    pt = latlon_to_local(item["lon"], item["lat"])
    cctv_points.append(pt)

    label = f"{item['count']}대\n{item['address']}"
    text = geo.TextEntity()
    text.Plane = geo.Plane(pt, geo.Vector3d.ZAxis)
    text.Text = label
    text.Height = 2.0
    text.Justification = geo.TextJustification.TopLeft
    cctv_texts.append(text)
# ---------- end cctv_point ----------
safe_point = Python3Script(pts=pt, police_pt=pt_3, stores=pt_2)  # -> circles, colors; inputs pts: list of Point3d, police_pt: Point3d, stores: list of Point3d
# ---------- safe_point: Python ----------
import Rhino.Geometry as geo
from System.Drawing import Color
import importlib
import ewha_utils




circles = []
colors = []

# 1. CCTV 중복 처리
"""한 구간에 cctv 여러 개가 설치되어 있는 경우를 감안"""
cctv_count = ewha_utils.count_duplicate_points(pts)

# 2. CCTV 원 생성
"""평균 20m 구간까지 관찰 가능하므로 20으로 설정 / 성능에 따라 변경 가능"""
for pt in pts:
    key = ewha_utils.point_to_key(pt)
    count = cctv_count[key]

    circle = geo.Circle(pt, 20.0)
    circles.append(circle)

    colors.append(ewha_utils.get_cctv_color(count))

# 3. 지구대 원 생성
"""약 1분 이내의 위치(약 50m)까지 안전하다고 간주"""
if police_pt:
    police_circle = geo.Circle(police_pt, 50.0)
    circles.append(police_circle)
    colors.append(Color.FromArgb(150, 0, 100, 255))  # 파랑

# 4. 편의점 원 생성
"""시야에서 보이는 정도의 위치(약 30m)까지 안전하다고 간주"""
if stores:
    for store_pt in stores:
        store_circle = geo.Circle(store_pt, 30.0)
        circles.append(store_circle)
        colors.append(Color.FromArgb(120, 0, 255, 0))  # 녹색
# ---------- end safe_point ----------
reloader = Python3Script(work=Button(), hard_mode=Toggle(True), package_name="ewha_utils")  # -> out, a; inputs hard_mode: Boolean, package_name: String
# ---------- reloader: Python ----------
import importlib
import sys
import scriptcontext as sc
import os
import types

def add_current_dir_to_sys_path():
    doc_path = sc.doc.Path
    if doc_path:
        dir_name = os.path.dirname(doc_path)
        parent_dir = os.path.dirname(dir_name)
        root_name = os.path.dirname(parent_dir)
        print(root_name)
        sys.path.append(root_name)
    else:
        return "Document has not been saved yet."

def reload_package(package):
    fn = package.__file__
    fn_dir = os.path.dirname(fn) + os.sep
    module_visit = {fn}
    
    def reload_recursive_ex(module):
        print(module)
        importlib.reload(module)
        for module_child in vars(module).values():
            if isinstance(module_child, types.ModuleType):
                fn_child = getattr(module_child, "__file__", None)
                if fn_child and fn_child.startswith(fn_dir) and fn_child not in module_visit:
                    module_visit.add(fn_child)
                    reload_recursive_ex(module_child)
    
    reload_recursive_ex(package)

def remove_modules(target_name):
    modules_to_remove = [m for m in sys.modules if target_name in m]
    for m in modules_to_remove:
        del sys.modules[m]
        print(f"{m} is deleted")

# 실행 코드

work = True

if work:
    add_current_dir_to_sys_path()
    if hard_mode:
        remove_modules(package_name)
    package = importlib.import_module(package_name)
    print(dir(package))
    reload_package(package)
# ---------- end reloader ----------
pt_4 = Point(cctv_point)
crv_2 = Curve(map.road_curves)
crv_3 = Curve(map.building_curves)
crv_4 = Curve(map.sidewalk_curves)
boundary = BoundarySurfaces(Edges=safe_point.circles)
crv_5 = Curve([<curve referenced from the Rhino model> x207])
pt_5 = Point(py3)
pt_6 = Point(<point referenced from the Rhino model>)
pt_7 = Point([<point referenced from the Rhino model> x6])
crv_6 = Curve([<curve referenced from the Rhino model> x3967])
pt_8 = Point([<point referenced from the Rhino model> x704])
panel = Panel(reloader.out)
safe_score = Python3Script(
    path_points=pt_5,
    cctvs=pt_8,
    obstacles=crv_6,
    max_distance=Slider(20, range=0..100),
    sidewalks=crv_5,
    step=Slider(8, range=0..10),
    cvs_list=pt_7,
    police_list=pt_6)  # -> safe_scores, cylinders, colors, scores_norm; inputs path_points: list of Point3d, cctvs: list of Point3d, obstacles: list of Curve, max_distance: Double, sidewalks: list of Curve, step: Double, cvs_list: list of Point3d, police_list: list of Point3d
# ---------- safe_score: Python ----------
import Rhino.Geometry as geo
import importlib
import ewha_utils



# 각 점별 안전 점수 계산
"""각 지역에 맞게 요소 추가해서 이용 가능하다"""
safe_scores = []
for pt in path_points:
    score = ewha_utils.check_point_safety(pt, cctvs, obstacles, sidewalks, cvs_list, police_list)
    safe_scores.append(score)

# 정규화
min_score = min(safe_scores)
max_score = max(safe_scores)
scores_norm = [(s - min_score) / (max_score - min_score) if max_score > min_score else 0 for s in safe_scores]

# 색상값 변환
"""어두울수록 안전하지 못한 길이다"""
colors = [score * 255 for score in scores_norm]

# 시각화용 면 생성
cylinders = []
for point in path_points:
    circle = geo.Circle(point, step / 2)
    extrusion = geo.Extrusion.Create(geo.ArcCurve(circle), 1, True)
    cylinders.append(extrusion)

# 평균 점수
"""평균 점수를 산출하여 각 경로당 안전성 비교"""
average_score = sum(safe_scores) / len(safe_scores)
print("평균 점수:", average_score)



# 경찰서 점수
"""각 요소별 점수가 궁금할 때 사용 가능"""
police_scores = []
for pt in path_points:
    score = ewha_utils.score_by_distance(pt, police_list, 50, 100)
    police_scores.append(score)
# ---------- end safe_score ----------
preview = CustomPreview(Geometry=boundary, Material=safe_point.colors)
rgb = ColourRGB(Alpha=255, Red=safe_score.colors, Green=safe_score.colors, Blue=safe_score.colors)
panel_2 = Panel(safe_score.safe_scores)
material = CreateMaterial(Diffuse=rgb, Specular=RGB(255, 255, 255), Emission=RGB(0, 0, 0), Transparency=0, Shine=0)
preview_2 = CustomPreview(Geometry=safe_score.cylinders, Material=material)
