# Grasshopper definition congestion.gh (Grasshopper 1.0.8)

reloader = Python3Script(work=Button(), hard_mode=Toggle(True), package_name="ewha_utils")  # -> out, a; inputs hard_mode: Boolean, package_name: String
# ---------- reloader: Python ----------
import importlib
import sys
import scriptcontext as sc
import os
import types

def add_current_dir_to_sys_path():
    doc_path = sc.doc.Path
    if doc_path:
        dir_name = os.path.dirname(doc_path)
        parent_dir = os.path.dirname(dir_name)
        root_name = os.path.dirname(parent_dir)
        print(root_name)
        sys.path.append(root_name)
    else:
        return "Document has not been saved yet."

def reload_package(package):
    fn = package.__file__
    fn_dir = os.path.dirname(fn) + os.sep
    module_visit = {fn}
    
    def reload_recursive_ex(module):
        print(module)
        importlib.reload(module)
        for module_child in vars(module).values():
            if isinstance(module_child, types.ModuleType):
                fn_child = getattr(module_child, "__file__", None)
                if fn_child and fn_child.startswith(fn_dir) and fn_child not in module_visit:
                    module_visit.add(fn_child)
                    reload_recursive_ex(module_child)
    
    reload_recursive_ex(package)

def remove_modules(target_name):
    modules_to_remove = [m for m in sys.modules if target_name in m]
    for m in modules_to_remove:
        del sys.modules[m]
        print(f"{m} is deleted")

# 실행 코드

work = True

if work:
    add_current_dir_to_sys_path()
    if hard_mode:
        remove_modules(package_name)
    package = importlib.import_module(package_name)
    print(dir(package))
    reload_package(package)
# ---------- end reloader ----------
panel = Panel(reloader.out)
visualize = Python3Script(
    bus_json_filename="bus_congestion_by_stop_id_reordered.json",
    subway_json_filename="subway_congestion_restructured_by_station_id.json",
    target_hour=Slider(14, range=0..23))  # -> out, bus_circles, bus_srfs, subway_circles, subway_srfs
# ---------- visualize: Python ----------
import ewha_utils
import json
import Rhino.Geometry as rg
import codecs  # 인코딩 문제 없이 파일 읽기 위해 사용

# 하나의 정류장 데이터에서 곡선과 면 생성하는 함수 정의
def get_congestion_geoms(lat, lon, congestion):
# 혼잡도 0이면 시각화할 의미 없으니 건너뜀
    if congestion == 0:
        return None, None

# 좌표 변환: 위도/경도를 Rhino 좌표계로 변환
    center = ewha_utils.geo_to_xy(lat, lon)

# 원 생성: 혼잡도를 바탕으로 원의 반지름 계산 -> 곡선으로 변환해서 출력 리스트에 추가
    radius = ewha_utils.congestion_to_radius(congestion)
    circle = rg.Circle(center, radius)
    crv = circle.ToNurbsCurve()

# 면 생성
    breps = rg.Brep.CreatePlanarBreps(crv)
    srf = breps[0]

# 곡선과 면 반환
    return crv, srf

def get_geoms_from_congestion_data(congestion_data):
    # 출력할 Curve와 Surface를 담을 리스트
    curves = []
    surfaces = []

    # 모든 정류장(stop_id)에 대해 반복 - 위도, 경도, 혼잡도 값, 곡선과 면 생성하여 리스트에 추가
    for stop_id, stop in congestion_data.items():
        lat = stop["latitude"]
        lon = stop["longitude"]
        congestion = stop["congestion_by_hour"].get(hour_key, 0)
        crv, srf =  get_congestion_geoms(lat, lon, congestion)
        if crv and srf:
            curves.append(crv)
            surfaces.append(srf)
    return curves, surfaces
def parse_hour_key(target_hour):
    # target_hour는 사용자가 입력한 시간값 (예: 8, "8", "8h" 등)
    # → 이걸 JSON 키로 쓰기 위해 '8h' 형태로 바꿔주는 처리
    try:
        hour_int = int(float(target_hour))
        hour_key = "{}h".format(hour_int)
    except:
        if isinstance(target_hour, str) and target_hour.endswith("h"):
            hour_key = target_hour
        else:
            raise ValueError("target_hour는 숫자(예: 8) 또는 문자열 '8h' 형식이어야 합니다.")
    return hour_key

hour_key = parse_hour_key(target_hour)
import os
import scriptcontext as sc
dirname = os.path.dirname(sc.doc.Path)
bus_data_path = os.path.join(dirname, bus_json_filename)
subway_data_path = os.path.join(dirname, subway_json_filename)
# 혼잡도 데이터 들어있는 JSON 파일 로딩
with open(bus_data_path, "r", encoding = "utf-8") as f:
    bus_congestion_data = json.load(f)
with open(subway_data_path, "r", encoding = "utf-8") as f:
    subway_congestion_data = json.load(f)


bus_circles, bus_srfs = get_geoms_from_congestion_data(bus_congestion_data)
subway_circles, subway_srfs = get_geoms_from_congestion_data(subway_congestion_data)
# ---------- end visualize ----------
crv = Curve(visualize.bus_circles)
brep = Brep(visualize.bus_srfs)
crv_2 = Curve(visualize.subway_circles)
brep_2 = Brep(visualize.subway_srfs)
