# Grasshopper definition 공구분 최종제출물_2173015 이수빈.gh (Grasshopper 1.0.8)

crv = Curve(<curve referenced from the Rhino model>)
block_instance = BlockInstance(<block instance referenced from the Rhino model>)
block_instance_2 = BlockInstance(<block instance referenced from the Rhino model>)
block_instance_3 = BlockInstance(<block instance referenced from the Rhino model>)
block_instance_4 = BlockInstance(<block instance referenced from the Rhino model>)
viewer = ParamViewer(block_instance)
code2_4unit_block_경로_따라_나열 = Python3Script(
    num_floors=Slider(8, range=0..15),
    block_dwelling=block_instance,
    block_void1=block_instance_4,
    block_void2=block_instance_2,
    block_empty=block_instance_3,
    path_curve=crv,
    bake=Toggle(False))  # -> out, unit_breps, r, g, b; inputs num_floors: Int32, path_curve: Curve, bake: Boolean
# ---------- code2_4unit_block_경로_따라_나열: Python ----------
import Rhino.Geometry as rg
import random
import Rhino

import sys
import os

# ✅ utils 폴더 경로를 실행 경로 기준으로 추가
base_dir = os.getcwd()  # 현재 gh 파일이 열려 있는 경로 기준
utils_path = os.path.join(base_dir, "utils")

if utils_path not in sys.path:
    sys.path.append(utils_path)

# ✅ geometry_utils 모듈에서 함수 import
from ewha_utils import (
    get_geoms_from_block_instance,
    get_obj_layer,
    create_block_instance,
    get_geoms_from_block_definition,
    find_block_definition_from_guid,
    geom_dict_to_list
)


### -----------------------------------------------------------
### 🔹 2. Block 정의 추출 및 그룹별 Brep 리스트 구성
### -----------------------------------------------------------

# ✅ 각 block instance의 원본 block 정의 ID (GUID)
void_dwelling_id = block_dwelling.ParentIdefId
void1_id = block_void1.ParentIdefId
void2_id = block_void2.ParentIdefId
void_empty_id = block_empty.ParentIdefId
""" Id (GUID)      → 고유 식별자, definition을 찾는 데 사용 """


# ✅ 현재 Rhino 문서 객체
rhino_doc = Rhino.RhinoDoc.ActiveDoc

# ✅ GUID로부터 block definition 찾기
void_dwelling_def = find_block_definition_from_guid(rhino_doc, void_dwelling_id)
void1_def = find_block_definition_from_guid(rhino_doc, void1_id)
void2_def = find_block_definition_from_guid(rhino_doc, void2_id)
void_empty_def = find_block_definition_from_guid(rhino_doc, void_empty_id)


# ✅ 이후 block instance 삽입을 위한 
void_dwelling_index  = void_dwelling_def.Index
void1_index  = void1_def.Index
void2_index  = void2_def.Index
void_empty_index  = void_empty_def.Index
""" Index (int)    → Rhino 문서 내부 리스트의 위치, 삽입 시 사용 """

# ✅ Dict 형태 geometry 모음을 단일 리스트로 변환
def geom_dict_to_list(geom_dict):
    result = []
    for geoms in geom_dict.values():
        result += geoms
    return result

# ✅ 각 block definition으로부터 geometry 리스트 구성
breps_dwelling = geom_dict_to_list(get_geoms_from_block_definition(rhino_doc, void_dwelling_def))
breps_void1    = geom_dict_to_list(get_geoms_from_block_definition(rhino_doc, void1_def))
breps_void2    = geom_dict_to_list(get_geoms_from_block_definition(rhino_doc, void2_def))
breps_empty    = geom_dict_to_list(get_geoms_from_block_definition(rhino_doc, void_empty_def))


### -----------------------------------------------------------
### 🔹 1. 속성별 유닛 색상 정의 및 Unit 클래스 선언
### -----------------------------------------------------------

# ✅속성별 유닛 컬러 코딩
# 속성(label)마다 미리 정의된 RGB 색상값을 설정하고
# r, g, b 리스트에 저장한다.
dwelling_color = (255,255,255) # 흰색
void_1_color = (250,228,167) # 연노랑
void_2_color = (247,205,165) # 연주황
empty_color = (246,195,164) # 주황 

# 최종 출력 리스트
unit_breps = []
r, g, b = [], [], []

### -----------------------------------------------------------
### 🔹 4. 경로 기반 유닛 배치 좌표 생성
### -----------------------------------------------------------

# ✅ 유닛 간 간격 및 경로 길이 기반 자동 계산
unit_spacing = 5200
path_length = path_curve.GetLength()
unit_count = int(path_length // unit_spacing)


# ✅ 일정 간격마다 t값 추출하여 path 위 포인트 생성
t_values = []
d = 0
while d <= min(path_length, unit_spacing * (unit_count - 1)):
    t = path_curve.LengthParameter(d)[1]
    t_values.append(t)
    d += unit_spacing


### -----------------------------------------------------------
### 🔹 5. 층별 unit label 구성 (dwelling / void / empty)
### -----------------------------------------------------------

# 🧩 속성 리스트 생성
    # ✅확장 가능성을 고려하여 최소 void 1개 보장하되,
    # ✅전체 유닛의 절반 이하로 void 허용한다.
unit_labels = []
for floor in range(int(num_floors)):
    min_voids = 1
    max_voids = unit_count // 2
    N_voids_floor = random.randint(min_voids, max_voids)
    """     
    # ✅확장 가능성을 고려하여 최소 void 1개 보장하되,
    # ✅전체 유닛의 절반 이하로 void 허용한다. 
    """

    N_void1 = random.randint(0, N_voids_floor)
    N_void2 = random.randint(0, N_voids_floor - N_void1)
    N_empty = N_voids_floor - N_void1 - N_void2
    N_dwellings = unit_count - N_voids_floor

    floor_labels = (
        ["dwelling"] * N_dwellings +
        ["void_1"] * N_void1 +
        ["void_2"] * N_void2 +
        ["empty"]   * N_empty
    )
    random.shuffle(floor_labels)
    unit_labels.extend(floor_labels)


### -----------------------------------------------------------
### 🔹 유닛 배치 관련 함수 정의
### -----------------------------------------------------------

# ✅ 유닛 배치 평면 생성 함수
def get_unit_plane(t_value, z_level):
    success, base_plane = path_curve.FrameAt(t_value)
    if not success:
        return None

    origin = base_plane.Origin + rg.Vector3d(0, 0, z_level * 4000)
    x_axis = base_plane.XAxis
    z_axis = rg.Vector3d(0, 0, 1)

    y_axis = rg.Vector3d.CrossProduct(z_axis, x_axis)
    z_axis = rg.Vector3d.CrossProduct(x_axis, y_axis)

    x_axis.Unitize()
    y_axis.Unitize()
    z_axis.Unitize()

    return rg.Plane(origin, x_axis, y_axis)

# ✅ 그룹 중심 기준으로 트랜스폼 수행
def get_transformed_geometries(group, source_plane, target_plane):
    all_pts = []
    for geo in group:
        all_pts.extend(geo.GetBoundingBox(True).GetCorners())
    group_center = rg.BoundingBox(all_pts).Center
    source_plane = rg.Plane(group_center, rg.Vector3d.XAxis, rg.Vector3d.YAxis)

    xform = rg.Transform.PlaneToPlane(source_plane, target_plane)
    transformed = []

    for geo in group:
        geo_copy = geo.Duplicate()
        geo_copy.Transform(xform)
        transformed.append(geo_copy)

    return transformed, xform

# ✅ 레이블에 따른 group/색상/블록ID 반환
def get_unit_by_label(label):
    if label == "dwelling":
        return breps_dwelling, dwelling_color, void_dwelling_index
    elif label == "void_1":
        return breps_void1, void_1_color, void1_index
    elif label == "void_2":
        return breps_void2, void_2_color, void2_index
    elif label == "empty":
        return breps_empty, empty_color, void_empty_index
    else:
        return None, None, None

### -----------------------------------------------------------
### 🔹 유닛 복제 및 배치 실행
### -----------------------------------------------------------

for idx, label in enumerate(unit_labels):
    x_idx = idx % unit_count
    z_idx = idx // unit_count

    plane = get_unit_plane(t_values[x_idx], z_idx)
    if plane is None:
        continue

    group, color, block_def_id = get_unit_by_label(label)
    if group is None:
        continue

    transformed_geoms, xform = get_transformed_geometries(group, None, plane)

    if bake:
        create_block_instance(rhino_doc, block_def_id, transform=xform)

    unit_breps.extend(transformed_geoms)
    r.extend([color[0]] * len(transformed_geoms))
    g.extend([color[1]] * len(transformed_geoms))
    b.extend([color[2]] * len(transformed_geoms))



### -----------------------------------------------------------
### 🔹 7. 최종 출력
### -----------------------------------------------------------
a = unit_breps
R = r
G = g
B = b
# ---------- end code2_4unit_block_경로_따라_나열 ----------
rgb = ColourRGB(Alpha=255, Red=code2_4unit_block_경로_따라_나열.r, Green=code2_4unit_block_경로_따라_나열.g, Blue=code2_4unit_block_경로_따라_나열.b)
material = CreateMaterial(Diffuse=rgb, Specular=RGB(255, 255, 255), Emission=RGB(0, 0, 0), Transparency=0, Shine=0)
preview = CustomPreview(Geometry=code2_4unit_block_경로_따라_나열.unit_breps, Material=material)

brep = Brep(<brep referenced from the Rhino model>)
code1_box형태로_나열_diagram = Python3Script(base_brep=brep, unit_count=Slider(7, range=4..8), num_floors=Slider(10, range=0..15))  # -> out, unit_breps, r, g, b, x, y; inputs base_brep: Brep, unit_count: Int32, num_floors: Int32, breps_delling: Brep, breps_void1: Brep, breps_void2: Brep, breps_empty: Brep
# ---------- code1_box형태로_나열_diagram: Python ----------
import Rhino.Geometry as rg
import random



### -----------------------------------------------------------
### 🔹 1. 유닛 속성별 색상 정의 및 Unit 클래스 선언
### -----------------------------------------------------------

# ✅속성별 유닛 컬러 코딩
# 속성(label)마다 미리 정의된 RGB 색상값을 설정하고
# r, g, b 리스트에 저장한다.
dwelling_color = (255,255,255) # 흰색
void_1_color   = (250,228,167) # 연노랑
void_2_color   = (247,205,165) # 연주황
empty_color    = (246,195,164) # 주황 

# ✅ Unit 클래스 정의
class Unit:
    def __init__(self, brep, label):
        self.brep = brep
        self.label = label
        self.color = self.get_color(label)

    def get_color(self, label):
        if label == "dwelling":
            return dwelling_color
        elif label == "void_1":
            return void_1_color
        elif label == "void_2":
            return void_2_color
        elif label == "empty":
            return empty_color
        else:
            raise Exception('no color')




### -----------------------------------------------------------
### 🔹 2. base_brep를 기반으로 전체 유닛 위치 생성
### -----------------------------------------------------------

# ✅ base_brep를 층수(num_floors), 가로 유닛 수(unit_count) 기준으로 복제하여 배치
all_breps = []
for floor in range(int(num_floors)):
    for i in range(int(unit_count)):
        move_vec = rg.Vector3d(i * 5200, 0, floor * 4000)
        brep_copy = base_brep.Duplicate()
        brep_copy.Transform(rg.Transform.Translation(move_vec))
        all_breps.append(brep_copy)




### -----------------------------------------------------------
### 🔹 3. 층별 유닛 속성 레이블 무작위 배정
### -----------------------------------------------------------
# 🧩 속성 리스트 생성

unit_labels = []
for floor in range(int(num_floors)):
    min_voids = 1
    max_voids = unit_count // 2
    N_voids_floor = random.randint(min_voids, max_voids)
    """     
    # ✅확장 가능성을 고려하여 최소 void 1개 보장하되,
    # ✅전체 유닛의 절반 이하로 void 허용한다. 
    """
    N_void1 = random.randint(0, N_voids_floor)
    N_void2 = random.randint(0, N_voids_floor - N_void1)
    N_empty = N_voids_floor - N_void1 - N_void2
    N_dwellings = unit_count - N_voids_floor

    if N_dwellings < 0:
        raise ValueError("층 단위 유닛 수보다 void 수가 많습니다.")

    floor_labels = (
        ["dwelling"] * N_dwellings +
        ["void_1"] * N_void1 +
        ["void_2"] * N_void2 +
        ["empty"]   * N_empty
    )
    random.shuffle(floor_labels)
    unit_labels.extend(floor_labels)




### -----------------------------------------------------------
### 🔹 4. Unit 객체 생성 및 출력 정보 구성
### -----------------------------------------------------------

# ✅ Unit 인스턴스 생성 및 시각화용 리스트 정리
unit_breps, r, g, b, units = [], [], [], [], []

for brep, label in zip(all_breps, unit_labels):
    unit = Unit(brep, label)
    units.append(unit)
    unit_breps.append(unit.brep)
    r.append(unit.color[0])
    g.append(unit.color[1])
    b.append(unit.color[2])




### -----------------------------------------------------------
### 🔹 5. 결과 요약 정보 출력
### -----------------------------------------------------------

# ✅ 비율 계산 및 예시 출력
N_units = len(all_breps)
N_voids = unit_labels.count("void_1") + unit_labels.count("void_2") + unit_labels.count("empty")
N_dwellings = unit_labels.count("dwelling")

dwelling_ratio = round(N_dwellings / float(N_units), 2)
void_ratio     = round(N_voids / float(N_units), 2)
ratio_str = "dwelling:void = {} : {}  ({} / {})".format(
    dwelling_ratio, void_ratio, N_dwellings, N_voids
)

x = units[0].brep
y = units[0].label

print("생성된 Brep 개수:", len(unit_breps))
print("r/g/b 개수:", len(r), len(g), len(b))
print("라벨 예시:", [unit.label for unit in units[:5]])
# ---------- end code1_box형태로_나열_diagram ----------
rgb_2 = ColourRGB(Alpha=255, Red=code1_box형태로_나열_diagram.r, Green=code1_box형태로_나열_diagram.g, Blue=code1_box형태로_나열_diagram.b)
material_2 = CreateMaterial(Diffuse=rgb_2, Specular=RGB(255, 255, 255), Emission=RGB(0, 0, 0), Transparency=0, Shine=0)
preview_2 = CustomPreview(Geometry=code1_box형태로_나열_diagram.unit_breps, Material=material_2)

reloader = Python3Script(work=Button(), hard_mode=Toggle(True), package_name="ewha_utils")  # -> out, a; inputs hard_mode: Boolean, package_name: String
# ---------- reloader: Python ----------
import importlib
import sys
import scriptcontext as sc
import os
import types

def add_current_dir_to_sys_path():
    doc_path = sc.doc.Path
    if doc_path:
        dir_name = os.path.dirname(doc_path)
        parent_dir = os.path.dirname(dir_name)
        root_name = os.path.dirname(parent_dir)
        print(root_name)
        sys.path.append(root_name)
    else:
        return "Document has not been saved yet."

def reload_package(package):
    fn = package.__file__
    fn_dir = os.path.dirname(fn) + os.sep
    module_visit = {fn}
    
    def reload_recursive_ex(module):
        print(module)
        importlib.reload(module)
        for module_child in vars(module).values():
            if isinstance(module_child, types.ModuleType):
                fn_child = getattr(module_child, "__file__", None)
                if fn_child and fn_child.startswith(fn_dir) and fn_child not in module_visit:
                    module_visit.add(fn_child)
                    reload_recursive_ex(module_child)
    
    reload_recursive_ex(package)

def remove_modules(target_name):
    modules_to_remove = [m for m in sys.modules if target_name in m]
    for m in modules_to_remove:
        del sys.modules[m]
        print(f"{m} is deleted")

# 실행 코드

work = True

if work:
    add_current_dir_to_sys_path()
    if hard_mode:
        remove_modules(package_name)
    package = importlib.import_module(package_name)
    print(dir(package))
    reload_package(package)
# ---------- end reloader ----------
panel = Panel(reloader.out)
