# Grasshopper definition 2176274_이예영.gh (Grasshopper 1.0.8)

panel = Panel("""{
"용산동2가": "용산2가동",
  "용산동4가": "용산2가동",
  "동자동": "남영동",
  "갈월동": "남영동",
  "산천동": "원효로2동",
"신창동": "원효로2동",
"원효로3가": "원효로2동",
"원효로4가": "원효로2동",
"청암동": "원효로2동",
"도원동": "용문동",
"동빙고동": "서빙고동",
"주성동": "서빙고동",
"용산동6가": "서빙고동",
"서계동": "청파동",
"청파동1가": "청파동",
"청파동2가": "청파동",
"청파동3가": "청파동",
"청파동4가": "청파동",
"원효로1가": "원효로1동",
"원효로2가": "원효로1동",
"남영동": "한강로동",
"용산동1가": "한강로동",
"용산동3가": "한강로동",
"용산동5가": "한강로동",
"한강로1가": "한강로동",
"한강로2가": "한강로동",
"한강로3가": "한강로동",
"문배동": "한강로동",
"신계동": "한강로동"
}""")
map = Python3Script()  # -> out, all_polygons, all_names, name_points
# ---------- map: Python ----------
"""
이 컴포넌트는 GeoJSON 데이터를 불러와 행정구역 경계선(Polygon)을 Rhino PolylineCurve로 변환하고,
각 경계선의 중심점을 계산해서 텍스트 위치로 활용할 수 있도록 한다.
GeoJSON 파일 경로는 Grasshopper 문서 저장 위치를 기준으로 자동 설정된다.
"""
import ewha_utils
import json
import Rhino.Geometry as geo
import os
import scriptcontext as sc


# GeoJSON 파일 불러오기
try:
    path = ewha_utils.get_json_path("TN_EMD_BNDRY.geojson")
    with open(path, "r", encoding="utf-8") as f:
        data = json.load(f)
except Exception as e:
    print(f"❌ JSON 파일 로드 실패: {e}")
    data = {}

# GeoJSON feature 처리
all_polygons = []     # 폴리라인 경계 곡선 리스트
all_names = []        # 행정동 이름 리스트
name_points = []      # 이름 텍스트 표시용 중심 좌표 리스트

features = data.get("features", [])
for feature in features:
    geom = feature.get("geometry", {})
    name = feature.get("properties", {}).get("ADZONE_NM", "이름 없음")
    
    polygons = ewha_utils.parse_geojson(geom)
    if polygons:
        for polygon in polygons:
            all_polygons.append(polygon)
            all_names.append(name)
            pt = ewha_utils.get_centroid(polygon)
            name_points.append(pt)
            
# 출력값
all_polygons     # 폴리라인 곡선들 (List[rg.PolylineCurve])
all_names        # 행정동 이름들 (List[str])
name_points      # 중심점(이름 텍스트 위치) (List[rg.Point3d])
# ---------- end map ----------
reloader = Python3Script(work=Button(), hard_mode=Toggle(True), package_name="ewha_utils")  # -> out, a; inputs hard_mode: Boolean, package_name: String
# ---------- reloader: Python ----------
import importlib
import sys
import scriptcontext as sc
import os
import types

def add_current_dir_to_sys_path():
    doc_path = sc.doc.Path
    if doc_path:
        dir_name = os.path.dirname(doc_path)
        parent_dir = os.path.dirname(dir_name)
        root_name = os.path.dirname(parent_dir)
        print(root_name)
        sys.path.append(root_name)
    else:
        return "Document has not been saved yet."

def reload_package(package):
    fn = package.__file__
    fn_dir = os.path.dirname(fn) + os.sep
    module_visit = {fn}
    
    def reload_recursive_ex(module):
        print(module)
        importlib.reload(module)
        for module_child in vars(module).values():
            if isinstance(module_child, types.ModuleType):
                fn_child = getattr(module_child, "__file__", None)
                if fn_child and fn_child.startswith(fn_dir) and fn_child not in module_visit:
                    module_visit.add(fn_child)
                    reload_recursive_ex(module_child)
    
    reload_recursive_ex(package)

def remove_modules(target_name):
    modules_to_remove = [m for m in sys.modules if target_name in m]
    for m in modules_to_remove:
        del sys.modules[m]
        print(f"{m} is deleted")

# 실행 코드

work = True

if work:
    add_current_dir_to_sys_path()
    if hard_mode:
        remove_modules(package_name)
    package = importlib.import_module(package_name)
    print(dir(package))
    reload_package(package)
# ---------- end reloader ----------
map_2 = Python3Script(dong_polygons=map.all_polygons, dong_names=map.all_names, merge_map=panel)  # -> out, flatten(surfaces), names_out, centers, flatten(boundaries), flatten(boundary_colors); inputs dong_polygons: list of Curve, dong_names: list of String
# ---------- map_2: Python ----------
"""
이 컴포넌트는 입력된 경계선(dong_polygons)과 동 이름(dong_names)을 받아,
merge_map에 따라 동 이름을 병합한 후, 
(예를 들어, 효창동과 청파동을 병합하려면 merge_map에 {"효창동": "청파동"} 형태로 지정)
각 병합된 동 이름별로 경계선을 합쳐 하나의 평면 Brep를 생성한다.

생성된 Brep에 대해 중심점과 외곽선을 계산하며,
외곽선에는 특정 색상(지정한 색상)이 할당되어 시각화에 활용한다.

Inputs:
  dong_polygons : 병합 전 경계선 (PolylineCurve[])
  dong_names  : 병합 전 동 이름 (str[])
  merge_map : {"효창동":"청파동", …} - 동 이름을 병합할 매핑 딕셔너리 (dict 또는 Panel)
"""

import Rhino.Geometry as geo
from System.Drawing import Color
from collections import defaultdict
import ewha_utils

def group_polygons_by_merge_map(curves, names, merge_map):
    # merge_map 타입 보정
    if isinstance(merge_map, str):
        try:
            merge_map = eval(merge_map)
        except:
            merge_map = {}
    elif merge_map is None:
        merge_map = {}

    # 병합된 이름 생성
    updated_names = [merge_map.get(name, name) for name in names]

    # 동 이름별로 곡선 그룹화
    group_dict = defaultdict(list)
    for name, curve in zip(updated_names, curves):
        group_dict[name].append(curve)
    
    return group_dict

# 병합 허용 오차 설정
tol = 0.01

# 입력된 이름과 곡선을 병합 기준에 따라 그룹화
merged_polygon_dict = group_polygons_by_merge_map(dong_polygons, dong_names, merge_map)

# 출력 리스트 초기화
surfaces = []
names_out = []
centers = []
boundaries = []

# 그룹별로 Brep 생성 및 정보 추출
for name, polygons in merged_polygon_dict.items():
    # 경계선 연결
    joined_polygons = geo.Curve.JoinCurves(polygons, tol)
    if not joined_polygons:
        continue

    breps = []
    for joined_polygon in joined_polygons:
        if joined_polygon.IsClosed:
            planar_breps = geo.Brep.CreatePlanarBreps(joined_polygon, tol)
            if planar_breps:
                breps += planar_breps

    if not breps:
        continue

    # 면 병합 (BooleanUnion)
    unioned_surfaces = geo.Brep.CreateBooleanUnion(breps, tol)
    if not unioned_surfaces:
        unioned_surfaces = breps

    for unioned_surface in unioned_surfaces:
        surfaces.append(unioned_surface)
        names_out.append(name)
        centers.append(ewha_utils.get_srf_center(unioned_surface))
        boundary = ewha_utils.get_joined_naked_boundary(unioned_surface, tol)
        boundaries.append(boundary if boundary else None)

# 외곽선 색상 지정 (HEX '#e3944e')
line_color = Color.FromArgb(227, 148, 78)
boundary_colors = [line_color] * len(boundaries)

# 출력값 (Grasshopper에서 output 변수로 설정)
surfaces         # 병합된 면 (List[geo.Brep])
names_out        # 병합된 면의 이름 (List[str])
centers          # 중심점 (List[geo.Point3d])
boundaries       # 외곽선 (List[geo.Curve])
boundary_colors  # 외곽선 색상 (List[Color])
# ---------- end map_2 ----------
panel_2 = Panel(reloader.out)
preview = CustomPreview(Geometry=map_2.boundaries, Material=map_2.boundary_colors)
color = Python3Script(surf_in=map_2.surfaces, name_in=map_2.names_out)  # -> out, flatten(mesh_in), flatten(colors), ratio; inputs surf_in: list of Brep, name_in: list of String
# ---------- color: Python ----------
"""
이 컴포넌트는 행정동 이름(name_in)에 해당하는 면(surf_in)에 대해
CSV 파일로부터 외국인 비율(%) 데이터를 불러오고, 그 값을 색상으로 시각화한다.
- 면(Brep)은 시각화를 위해 Mesh로 변환되며,
  외국인 비율값에 따라 색상이 매핑되어 출력된다.
- CSV 파일은 Grasshopper 문서(.gh)의 경로 기준으로 상대 경로로 로드된다.
- 잘못된 동 이름 또는 누락된 데이터는 별도로 표시한다.

Inputs:
  surf_in : 대상 면(Brep 또는 List[Brep])
  name_in : 해당 면의 이름(str 또는 List[str])
"""

import os
import csv
import Rhino.Geometry as rg
import scriptcontext as sc
from System.Drawing import Color


def normalize(name):
    """동 이름의 괄호 및 공백 제거"""
    if not isinstance(name, str): return ""
    return name.strip().split('(')[0].replace(' ', '').replace('\t', '')

def hex_to_color(hexstr):
    """'#RRGGBB' → Color 객체로 변환"""
    h = hexstr.lstrip('#')
    return Color.FromArgb(int(h[0:2], 16), int(h[2:4], 16), int(h[4:6], 16))

def brighten(color, strength=0.4):
    """색상을 지정 강도로 밝게 조정"""
    r = int(color.R + (255 - color.R) * strength)
    g = int(color.G + (255 - color.G) * strength)
    b = int(color.B + (255 - color.B) * strength)
    return Color.FromArgb(r, g, b)

def blend(c1, c2, s):
    """두 색상 사이 보간"""
    return Color.FromArgb(
        int(c1.R + (c2.R - c1.R) * s),
        int(c1.G + (c2.G - c1.G) * s),
        int(c1.B + (c2.B - c1.B) * s),
    )

# 색상 맵핑
def color_ramp(t):
    """0~1의 값(t)에 따라 외국인 비율 색상 반환"""
    t = t ** 0.8  # 낮은 값 강조

    COL_1 = brighten(hex_to_color('#e8dc0c'), 0.45)
    COL_2 = brighten(hex_to_color('#edc814'), 0.3)
    COL_3 = brighten(hex_to_color('#f3ac19'), 0.01)
    COL_4 = brighten(hex_to_color('#f28f14'), 0.15)
    COL_5 = brighten(hex_to_color('#e97311'), 0.15)

    if t <= 0.15: return COL_1
    elif t <= 0.20: return blend(COL_1, COL_2, (t - 0.15) / 0.05)
    elif t <= 0.40: return COL_2
    elif t <= 0.60: return blend(COL_2, COL_3, (t - 0.40) / 0.20)
    elif t <= 0.70: return blend(COL_3, COL_4, (t - 0.60) / 0.10)
    else: return blend(COL_4, COL_5, (t - 0.70) / 0.30)

def create_color_map(vals, max_pct=20.0):
    """비율값 리스트 → [0~1 정규값], 색상 리스트"""
    colors, t_vals = [], []
    max_pct = max(max_pct, 1.0)
    for val in vals:
        t = max(0.0, min(float(val) / max_pct, 1.0))
        t_vals.append(t)
        colors.append(color_ramp(t))
    return colors, t_vals

# CSV 불러오기
def get_csv_path(filename="용산구 등록인구.csv"):
    """Grasshopper 문서 기준 상대경로로 CSV 경로 반환"""
    gh_path = sc.doc.Path
    if gh_path:
        return os.path.join(os.path.dirname(gh_path), filename)
    raise Exception("⚠️ Grasshopper 문서를 먼저 저장하세요.")

def load_ratio_data(csv_path):
    """CSV → {행정동: 외국인 비율} 딕셔너리 반환"""
    data = {}
    if not os.path.exists(csv_path):
        print("❌ CSV 파일이 존재하지 않음:", csv_path)
        return data

    with open(csv_path, 'r', encoding='utf-8-sig') as f:
        reader = csv.DictReader(f)
        for row in reader:
            try:
                key = normalize(row['행정동'])
                val_str = row['외국인비율(%)'].replace('%', '').strip()
                if val_str:
                    data[key] = float(val_str)
            except Exception as e:
                print("❌ 파싱 오류:", e, "→", row)
    return data

# 시각화
def assign_foreign_ratios(name_in, surf_in, ratio_dict):
    """
    동 이름(name_in)과 면(surf_in)을 기반으로:
    - 외국인 비율을 가져오고
    - Brep → Mesh 변환
    - 누락된 데이터도 기록
    """
    name_in = name_in if isinstance(name_in, list) else [name_in]
    surf_in = surf_in if isinstance(surf_in, list) else [surf_in]

    mesh_list, names, vals, missing = [], [], [], []
    for name, surf in zip(name_in, surf_in):
        if not isinstance(surf, rg.Brep): continue

        # Brep → Mesh 변환
        mesh_parts = rg.Mesh.CreateFromBrep(surf, rg.MeshingParameters.Coarse)
        if not mesh_parts: continue
        m = rg.Mesh()
        for p in mesh_parts:
            m.Append(p)
        m.Normals.ComputeNormals()
        m.Compact()
        mesh_list.append(m)
        names.append(name)

        # 외국인 비율 추출
        nm = normalize(name)
        val = ratio_dict.get(nm, 0.0)
        if nm not in ratio_dict:
            missing.append(name)
        vals.append(val)

    return mesh_list, names, vals, missing

try:
    csv_path = get_csv_path()
except Exception as e:
    print(str(e))
    csv_path = ""

ratio_dict = load_ratio_data(csv_path)
mesh_in, names, ratio, missing = assign_foreign_ratios(name_in, surf_in, ratio_dict)
colors, t_vals = create_color_map(ratio)

# 출력값
mesh_in     # 외국인 비율이 매핑된 Mesh 목록
colors      # 외국인 비율 기반 색상 리스트
ratio       # 외국인 비율 값 (% 기준)
# ---------- end color ----------
name = Python3Script(center_pt=map_2.centers, name=map_2.names_out, offset_x=Slider(185, range=0..1000))  # -> out, a, b; inputs center_pt: list of Point3d, name: list of String, offset_x: Double
# ---------- name: Python ----------
"""
이 스크립트는 입력된 중심점 리스트(center_pt)를 기준으로,
각 점을 X축 음수 방향으로 offset_x만큼 이동시킨 새로운 점 리스트를 생성한다.
이는 예를 들어 면의 중심에 동 이름 텍스트를 배치할 때,
텍스트가 겹치지 않도록 약간 왼쪽으로 이동시키기 위해 사용된다.

Inputs:
- center_pt : 기준이 되는 중심점들의 리스트 (List[Point3d])
- name      : 각 점에 대응하는 이름들의 리스트 (List[str])
- offset_x  : 중심점을 X축 방향으로 이동할 거리 (float, 음수 방향)
"""

import Rhino.Geometry as rg

# 중심점을 X축 음수 방향으로 offset_x만큼 이동
# 각 점 pt의 X좌표에서 offset_x를 빼고, Y/Z는 그대로 유지
moved_pts = [rg.Point3d(pt.X - offset_x, pt.Y, pt.Z) for pt in center_pt]

# 출력값
a = moved_pts               # 이동된 점들의 리스트 (List[rg.Point3d])
b = name                    # 입력으로 받은 이름 리스트 (List[str])
# ---------- end name ----------
tag = TextTag3D(Location=name.a, Text=name.b, Size=Slider(60, range=0..100), Justification=7)
preview_2 = CustomPreview(Geometry=color.mesh_in, Material=color.colors)
