# Grasshopper definition 기말프로젝트_이정현.gh (Grasshopper 1.0.8)

getpath = Python3Script(river_file_name="N3L_E0020000.geojson", road_file_name="N3L_A0020000.geojson")  # -> out, road_path, river_path
# ---------- getpath: Python ----------
import Rhino
import os
doc_path = Rhino.RhinoDoc.ActiveDoc.Path

dir_name = os.path.dirname(doc_path)
geojson_folder = "final_geojson"
river_path = f"{dir_name}/{geojson_folder}/{river_file_name}"
road_path = f"{dir_name}/{geojson_folder}/{road_file_name}"
# ---------- end getpath ----------
point = Point([Point(197958.744, 516134.995, 34), Point(198189.524, 516381.347, 25), Point(198384.3705, 516428.78, 34), Point(198373.758, 516122.752, 43), Point(198623.728, 516143.649, 25), Point(198669.828, 516328.168, 25)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])
point_2 = Point(Point(198899.4288, 515166.4504, 0))
point_3 = Point([Point(198475.303, 515281.162, 25), Point(198644.9305, 515333.6255, 37), Point(198738.738, 515308.6305, 34), Point(198960.097, 515806.705, 31), Point(198705.698, 516024.999, 40)])
point_4 = Point([Point(199320.5672, 514852.7455, 0), Point(199028.426, 514634.44, 0), Point(199028.426, 514461.4076, 0), Point(199472.7044, 514461.4076, 0), Point(199598.3924, 514461.4076, 0), Point(199598.3924, 514970.333, 0), Point(199484.3311, 514970.333, 0), Point(198449.5751, 514970.333, 0)])
point_5 = Point([Point(198793.451, 514787.148, 37), Point(199125.6818, 514731.2718, 0), Point(199201.3211, 514982.9227, 0), Point(199244.25, 514562.712, 23), Point(198991.493, 514543.185, 31), Point(198984.845, 514257.108, 25), Point(199422.898, 514271.291, 23), Point(199611.8097, 514762.525, 0), Point(199619.6745, 515015.9779, 0), Point(199708.2875, 515132.9105, 0), Point(199874.9825, 514900.8375, 0), Point(199726.871, 514374.261, 20), Point(199942.0003, 514143.7601, 0)])
number_slider = Slider(8, range=0..100)
도로중심선_기반_data = Python3Script(
    geojson_path_road=getpath.road_path,
    geojson_path_river=getpath.river_path,
    start_pts=point,
    site=point_2,
    final_pts_industrial=point_3,
    final_pts_agriculture=point_4,
    final_pts_river=point_5)  # -> out, paths_to_site, paths_industrial, paths_agriculture, paths_river; inputs geojson_path_road: String, start_pts: list of Point3d, site: Point3d, final_pts_industrial: list of Point3d, final_pts_agriculture: list of Point3d, final_pts_river: list of Point3d
# ---------- 도로중심선_기반_data: Python ----------
import json
import Rhino.Geometry as geo
import heapq
import os
import System.Drawing
import ewha_utils
from ewha_utils import PathFinder 
import Grasshopper



def get_path_points_to_point(path_finder, start_pts, end_pt):
    res = [] 
    for start_pt in start_pts:
        path = path_finder.process(start_pt, end_pt)
        res.append(path)
    return res

# 데이터 로드 
print(geojson_path_road)
road_data = ewha_utils.get_geojson_data(geojson_path_road)
road_lines = ewha_utils.geojson_to_rhino_geometry(road_data)
river_data = ewha_utils.get_geojson_data(geojson_path_river)
river_lines = ewha_utils.geojson_to_rhino_geometry(river_data)

# 각 지점 -> 사이트 경로
path_finder = PathFinder(road_lines)
paths_to_site = get_path_points_to_point(path_finder, start_pts, site)
paths_industrial = get_path_points_to_point(path_finder, final_pts_industrial, site)
paths_agriculture = get_path_points_to_point(path_finder, final_pts_agriculture, site)

# 사이트 -> 하천 경로
river_path_finder = PathFinder(river_lines)
paths_river = []
for pt in final_pts_river:
    path = river_path_finder.process(site, pt)
    paths_river.append(path)
# ---------- end 도로중심선_기반_data ----------
reloader = Python3Script(work=Button(), hard_mode=Toggle(True), package_name="ewha_utils")  # -> out, a; inputs hard_mode: Boolean, package_name: String
# ---------- reloader: Python ----------
import importlib
import sys
import scriptcontext as sc
import os
import types

def add_current_dir_to_sys_path():
    doc_path = sc.doc.Path
    if doc_path:
        dir_name = os.path.dirname(doc_path)
        parent_dir = os.path.dirname(dir_name)
        root_name = os.path.dirname(parent_dir)
        print(root_name)
        sys.path.append(root_name)
    else:
        return "Document has not been saved yet."

def reload_package(package):
    fn = package.__file__
    fn_dir = os.path.dirname(fn) + os.sep
    module_visit = {fn}
    
    def reload_recursive_ex(module):
        print(module)
        importlib.reload(module)
        for module_child in vars(module).values():
            if isinstance(module_child, types.ModuleType):
                fn_child = getattr(module_child, "__file__", None)
                if fn_child and fn_child.startswith(fn_dir) and fn_child not in module_visit:
                    module_visit.add(fn_child)
                    reload_recursive_ex(module_child)
    
    reload_recursive_ex(package)

def remove_modules(target_name):
    modules_to_remove = [m for m in sys.modules if target_name in m]
    for m in modules_to_remove:
        del sys.modules[m]
        print(f"{m} is deleted")

# 실행 코드

work = True

if work:
    add_current_dir_to_sys_path()
    if hard_mode:
        remove_modules(package_name)
    package = importlib.import_module(package_name)
    print(dir(package))
    reload_package(package)
# ---------- end reloader ----------

pipe = Pipe(Curve=도로중심선_기반_data.paths_to_site, Radius=number_slider, Caps=0)
custom_preview = CustomPreview(Geometry=pipe, Material=ColourSwatch(SwatchColor=RGB(71, 71, 71)))

pipe_2 = Pipe(Curve=도로중심선_기반_data.paths_river, Radius=number_slider, Caps=0)
pipe_3 = Pipe(Curve=도로중심선_기반_data.paths_agriculture, Radius=number_slider, Caps=0)
pipe_4 = Pipe(Curve=도로중심선_기반_data.paths_industrial, Radius=number_slider, Caps=0)
custom_preview_2 = CustomPreview(Geometry=pipe_4, Material=ColourSwatch(SwatchColor=RGB(242, 70, 73)))
custom_preview_3 = CustomPreview(Geometry=pipe_3, Material=ColourSwatch(SwatchColor=RGB(59, 209, 73)))
custom_preview_4 = CustomPreview(Geometry=pipe_2, Material=ColourSwatch(SwatchColor=RGB(13, 51, 195)))

panel = Panel(reloader.out)
