# Grasshopper definition Eval_Seats.gh (Grasshopper 1.0.8)
# plug-ins: Fologram for Grasshopper

createseats = Python3Script()  # -> out, seats
# ---------- createseats: Python ----------
import Rhino
import Rhino.Geometry as geo
import rhinoscriptsyntax as rs
import scriptcontext as sc
import math

import ewha_utils
from ewha_utils.seat import Seat
sc.doc = Rhino.RhinoDoc.ActiveDoc

desk_geos = ewha_utils.get_geoms_in_layer("Seat_Desks")
chair_geos = ewha_utils.get_geoms_in_layer("Seat_Chairs")
screen_geos = ewha_utils.get_geoms_in_layer("Seat_Screens")
crit_desk = ewha_utils.get_geoms_in_layer("Commons_CritDesk")
trash_bin = ewha_utils.get_geoms_in_layer("Commons_TrashBin")
fridge = ewha_utils.get_geoms_in_layer("Commons_Fridge")
printer = ewha_utils.get_geoms_in_layer("Commons_Printer")
door = ewha_utils.get_geoms_in_layer("Commons_Door")
basin = ewha_utils.get_geoms_in_layer("Commons_Basin")

sc.doc = ghdoc




# ========== 실행 ========== #
desk_geos = ewha_utils.sort_desks_by_y(desk_geos)
screen_geos = ewha_utils.sort_by_closest(screen_geos, desk_geos)
chair_geos = ewha_utils.sort_by_closest(chair_geos, desk_geos)

seats = []
index = 1
for desk, screen, chair in zip(desk_geos, screen_geos, chair_geos):
    seat = Seat(index, desk, screen, chair) 
    seats.append(seat)
    index +=1
# ---------- end createseats ----------
augdoc = AugmentedDocument(augmented_trigger_0_key=list, num_augmented_triggers=1)
# 항목별 점수 산출
reloader = Python3Script(work=Button(), hard_mode=Toggle(True), package_name="ewha_utils")  # -> out, a; inputs hard_mode: Boolean, package_name: String
# ---------- reloader: Python ----------
import importlib
import sys
import scriptcontext as sc
import os
import types

def add_current_dir_to_sys_path():
    doc_path = sc.doc.Path
    if doc_path:
        dir_name = os.path.dirname(doc_path)
        parent_dir = os.path.dirname(dir_name)
        root_name = os.path.dirname(parent_dir)
        print(root_name)
        sys.path.append(root_name)
    else:
        return "Document has not been saved yet."

def reload_package(package):
    fn = package.__file__
    fn_dir = os.path.dirname(fn) + os.sep
    module_visit = {fn}
    
    def reload_recursive_ex(module):
        print(module)
        importlib.reload(module)
        for module_child in vars(module).values():
            if isinstance(module_child, types.ModuleType):
                fn_child = getattr(module_child, "__file__", None)
                if fn_child and fn_child.startswith(fn_dir) and fn_child not in module_visit:
                    module_visit.add(fn_child)
                    reload_recursive_ex(module_child)
    
    reload_recursive_ex(package)

def remove_modules(target_name):
    modules_to_remove = [m for m in sys.modules if target_name in m]
    for m in modules_to_remove:
        del sys.modules[m]
        print(f"{m} is deleted")

# 실행 코드

work = True

if work:
    add_current_dir_to_sys_path()
    if hard_mode:
        remove_modules(package_name)
    package = importlib.import_module(package_name)
    print(dir(package))
    reload_package(package)
# ---------- end reloader ----------
# 항목별 시각화
panel = Panel(reloader.out)
srf = Surface([<surface referenced from the Rhino model> x2])
brep = Brep(<brep referenced from the Rhino model>)

vent = Python3Script(seats=createseats.seats)  # -> out, a, seats; inputs seats: list
# ---------- vent: Python ----------
import Rhino
import Rhino.Geometry as geo
import rhinoscriptsyntax as rs
import scriptcontext as sc

import ewha_utils 
sc.doc = Rhino.RhinoDoc.ActiveDoc


# ========== Rhino 객체 불러오기 ========== #


window_geos = ewha_utils.get_geoms_in_layer("Environ_Window")

# ========== 실행 ========== #


for seat in seats:
    seat.update_ventilation_score(window_geos)

# ========== 결과 출력 ========== #
for i, seat in enumerate(seats):
    print(f"[Seat {i+1}] Ventilation Score: {seat.ventilation_score:.2f}")
# ---------- end vent ----------
movement = Python3Script(
    seats=vent.seats,
    crit_weight=Slider(0.274, range=0..1),
    trash_weight=Slider(0.311, range=0..1),
    fridge_weight=Slider(0.796, range=0..1),
    printer_weight=Slider(0.854, range=0..1),
    door_weight=Slider(0.702, range=0..1),
    basin_weight=Slider(0.349, range=0..1))  # -> out, a, s, seats; inputs seats: list, basin_weight: Double
# ---------- movement: Python ----------
import Rhino
import Rhino.Geometry as geo
import rhinoscriptsyntax as rs
import scriptcontext as sc
import math

import ewha_utils
from ewha_utils.seat import Seat
sc.doc = Rhino.RhinoDoc.ActiveDoc



# ========== 라이노 레이어에서 객체 불러오기 ========== #


crit_desk = ewha_utils.get_geoms_in_layer("Commons_CritDesk")
trash_bin = ewha_utils.get_geoms_in_layer("Commons_TrashBin")
fridge = ewha_utils.get_geoms_in_layer("Commons_Fridge")
printer = ewha_utils.get_geoms_in_layer("Commons_Printer")
door = ewha_utils.get_geoms_in_layer("Commons_Door")
basin = ewha_utils.get_geoms_in_layer("Commons_Basin")

sc.doc = ghdoc

# ========== 동선 간섭 요소 및 가중치 설정 ========== #
commons = crit_desk + trash_bin + fridge + printer + door
weights = (
    [crit_weight] * len(crit_desk) +
    [trash_weight] * len(trash_bin) +
    [fridge_weight] * len(fridge) +
    [printer_weight] * len(printer) +
    [door_weight] * len(door) +
    [basin_weight] * len(basin)
)


# 점수 계산 및 정규화
for seat in seats:
    seat.evaluate_movement(commons, weights)

max_score = max(seat.movement_score for seat in seats if seat.movement_score is not None)
for seat in seats:
    seat.norm_score = 10 * (1 - seat.movement_score / max_score) if max_score > 0 else 10.0

# ========== 결과 출력 ========== #
for i, seat in enumerate(seats):
    print(f"[Seat {i+1}]  Movement Score: {seat.norm_score:.2f}")

s = [seat.norm_score for seat in seats]
# ---------- end movement ----------
sunlight = Python3Script(seats=movement.seats)  # -> out, a, window_geos, obstacles, seats; inputs seats: list
# ---------- sunlight: Python ----------
import Rhino
import Rhino.Geometry as geo
import rhinoscriptsyntax as rs
import scriptcontext as sc
import math
import datetime

import ewha_utils  # common.py 함수들 자동 import됨



# ========== Rhino 객체 불러오기 ========== #
sc.doc = Rhino.RhinoDoc.ActiveDoc
window_geos = ewha_utils.get_geoms_in_layer("Environ_Window")

shelves_geos = ewha_utils.get_geoms_in_layer("Commons_Shelves")
monitors_geos = ewha_utils.get_geoms_in_layer("Seat_Monitors")
columns_geos = ewha_utils.get_geoms_in_layer("COL")
all_rays = ewha_utils.get_all_rays(window_geos)
# 장애물 정리
obstacles = []
for geom in shelves_geos + monitors_geos + columns_geos:
    if isinstance(geom, geo.Extrusion):
        geom = geom.ToBrep()
    obstacles.append(geom)


for seat in seats:
    seat.evaluate_sunlight(all_rays, obstacles)

max_score = max(seat.sunlight_score for seat in seats)

for seat in seats:
    seat.set_sunlight_norm_score((seat.sunlight_score/max_score) * 10)


# ========== 출력 ========== #
for i, seat in enumerate(seats):
    print(f"[Seat {i+1}] Raw: {seat.sunlight_score}, Normalized: {seat.sunlight_norm_score:.1f}")
# ---------- end sunlight ----------
privacy = Python3Script(seats=sunlight.seats, room=brep, door=srf)  # -> out, a, b, d, s, seats, text_dots; inputs seats: list, room: Brep, door: list of Surface
# ---------- privacy: Python ----------
import Rhino.Geometry as geo
import math
import Rhino
import rhinoscriptsyntax as rs
import scriptcontext as sc

# ========== 유틸 함수 임포트 ========== #
import ewha_utils
# ========== 보조 함수들 ========== #

# ========== Rhino 객체 불러오기 ========== #

sc.doc = Rhino.RhinoDoc.ActiveDoc


def find_closest_screen(seat, screen_geos):
    for screen_face in screen_geos:
        bbox = seat.screen.GetBoundingBox(True)
        if bbox.Contains(screen_face.PointAt(0.5,0.5)):
            return screen_face
    raise ValueError("seat not found")

screen_geos_raw = ewha_utils.get_geoms_in_layer("Seat_Screens")
screen_geos = [ewha_utils.ensure_surface(s) for s in screen_geos_raw if ewha_utils.ensure_surface(s) is not None]
crit_geos = ewha_utils.get_geoms_in_layer("Commons_CritDesk")
obstacles = [obj for obj in screen_geos_raw if isinstance(obj, geo.Brep) and ewha_utils.ensure_surface(obj) not in screen_geos]
for seat in seats:
    screen_face_on_seat = find_closest_screen(seat, screen_geos)
    seat.set_screen_face(screen_face_on_seat)



# ========== Ray 시뮬레이션 입력 설정 ========== #

rays_base_vectors = []
if door and room:
    for d in door:
        origin = ewha_utils.get_door_center(d)
        vec = ewha_utils.get_door_inside_vector(d, room)
        rays_base_vectors.append((origin, vec, 60))

for crit in crit_geos:
    if isinstance(crit, geo.Brep):
        origin_xy = ewha_utils.get_top_center(crit)
        target_z = seats[0].screen_center_z if seats else origin_xy.Z
        origin = geo.Point3d(origin_xy.X, origin_xy.Y, target_z)
        base_vec = geo.Vector3d(1, 0, 0)
        rays_base_vectors.append((origin, base_vec, 180))

# ========== 평가 실행 ========== #

for i, seat in enumerate(seats):
    seat.evaluate_privacy(rays_base_vectors, obstacles, seat_index=i)

max_score  = max(s.privacy_score for s in seats if s.privacy_score not in (None, 0.0))


for seat in seats:
    norm_privacy_score = 10 * (seat.privacy_score / max_score) if max_score > 0 else 0.0
    seat.set_privacy_norm_score(norm_privacy_score)

for i, seat in enumerate(seats):
    print(f"[Seat {i+1}]  Privacy Score: {seat.privacy_score:.2f}")
# ---------- end privacy ----------

brep_2 = Brep(sunlight.obstacles)
brep_3 = Brep(sunlight.window_geos)
list = ValueList({"Vent", "Sunlight", "Movement", "Privacy"}, selected="Privacy")

# ----
# 전체 점수 계산
number_slider = Slider(0.269, range=0..1)
total_points = Python3Script(
    seats=privacy.seats,
    w_privacy=number_slider,
    w_sunlight=Slider(1, range=0..1),
    w_ventilation=Slider(0.15, range=0..1),
    w_movement=Slider(0, range=0..1))  # -> out, seats, total_scores, number_dots, score_dots, rank_dots; inputs seats: list, w_privacy: Double, w_sunlight: Double, w_ventilation: Double, w_movement: Double
# ---------- total_points: Python ----------
import System
import math
import Rhino
import Rhino.Geometry as geo
import rhinoscriptsyntax as rs
import scriptcontext as sc
import ewha_utils

total_scores= [seat.compute_total_score(w_privacy, w_sunlight, w_movement, w_ventilation) for seat in seats]  # 최종 점수 리스트

# ========== 좌석 번호 시각화 (TextDot) ========== #
number_dots = []
for i, seat in enumerate(seats):
    dot = geo.TextDot(str(i + 1), seat.position)
    number_dots.append(dot)

score_dots = []
for seat in seats:
    score_pt = seat.get_bottom_center()
    score_dot = geo.TextDot(f"{seat.total_score:.1f}", score_pt)
    score_dots.append(score_dot)

rank_dots = []

# ========== 총점 기반 좌석 순위 계산 ========== #
sorted_seats = sorted(seats, key=lambda s: s.total_score, reverse=True)  # 높은 점수부터 정렬
rank_dict = {seat.index: rank + 1 for rank, seat in enumerate(sorted_seats)}  # index별 순위 매핑

for seat in seats:
    rank = rank_dict[seat.index]
    pt = seat.get_top_center()
    dot = geo.TextDot(str(rank), pt)
    rank_dots.append(dot)
# ---------- end total_points ----------

visualize = Python3Script(mode=list, seats=privacy.seats, centers=vent.a, scores=vent.seats)  # -> out, geoms, colors, hit_points, hit_rays, desks, screens, chairs; inputs mode: String, seats: list, centers: list of Point3d, scores: list of Double
# ---------- visualize: Python ----------
import Rhino
import Rhino.Geometry as geo
import rhinoscriptsyntax as rs
import scriptcontext as sc
from System.Drawing import Color
sc.doc = Rhino.RhinoDoc.ActiveDoc
# ========== 유틸 함수 임포트 ========== #
import ewha_utils
from ewha_utils.seat import Visualizer

visualizer = Visualizer(mode, seats )
if mode == "Privacy":
    score_dots, hit_points, hit_rays = visualizer.visualize()
else:
    geoms, colors = visualizer.visualize()

desks = [seat.desk for seat in seats] 
chairs = [seat.chair for seat in seats] 
screens = [seat.screen for seat in seats]
# ---------- end visualize ----------
material = CreateMaterial(Diffuse=visualize.colors, Specular=RGB(255, 254, 254), Emission=RGB(0, 0, 0), Transparency=0, Shine=0)
preview = CustomPreview(Geometry=visualize.geoms, Material=material)

T = TextDot(total_points.rank_dots)
panel_2 = Panel(total_points.total_scores)
# 점핑 정하
mesh = Mesh(<mesh referenced from the Rhino model>)

trigger = Trigger(Interval=100, TimerInterval=100, Target=rec)  # disabled
jump_path = Python3Script(jh=mesh, seats=total_points.seats)  # -> out, a; inputs jh: Mesh, seats: list
# ---------- jump_path: Python ----------
import Rhino
import Rhino.Geometry as geo
import rhinoscriptsyntax as rs
import scriptcontext as sc
import math


target_pt = max(seats, key= lambda seat : seat.total_score).position

# ========== 친구(jh)의 Mesh 중심점 구하기 ========== #
if jh:  # jh: 친구의 Mesh 객체
    bbox = jh.GetBoundingBox(True)
    person_center = bbox.Center
else:
    person_center = geo.Point3d.Origin

# ========== 점프 경로 생성 ========== #
jump_count = 3            # 총 점프 횟수
jump_height = 300         # 점프 높이
steps_per_jump = 10       # 점프 당 프레임 수
total_steps = jump_count * steps_per_jump

jump_path = []
for i in range(total_steps + 1):
    t = float(i) / total_steps
    x = (1 - t) * person_center.X + t * target_pt.X
    y_ = (1 - t) * person_center.Y + t * target_pt.Y
    z_base = (1 - t) * person_center.Z + t * target_pt.Z

    jump_phase = (t * jump_count) % 1.0  # 각 점프 내에서의 위치 (0~1)
    z_offset = jump_height * abs(math.sin(jump_phase * math.pi))  # 사인 곡선 기반 점프 곡률
    z = z_base + z_offset

    jump_path.append(geo.Point3d(x, y_, z))

# ========== 출력 ========== #
a = geo.Polyline(jump_path).ToNurbsCurve()
# ---------- end jump_path ----------
rec = DataRecorder(Slider(100, range=0..100), DataLimit=10, RecordData=True)  # disabled
lng = ListLength(List=rec)
jump = Python3Script(trigger=lng, jump_path=jump_path.a, speed=Slider(200, range=0..1000), jh=mesh, reset=Button())  # -> out, a, b; inputs jump_path: Curve, speed: Double, jh: Mesh, reset: Boolean
# ---------- jump: Python ----------
import Rhino
import Rhino.Geometry as geo
import scriptcontext as sc
import System

# ========== JumpingAgent 클래스 정의 ========== #
class JumpingAgent:
    def __init__(self, mesh, path, speed=200.0):
        """
        mesh: 이동할 대상 Mesh 객체
        path: NurbsCurve 타입의 이동 경로
        speed: 이동 속도 (mm/frame)
        """
        self.original = mesh            # 원본 Mesh
        self.mesh = mesh                # 현재 위치의 Mesh
        self.path = path                # 경로 Curve
        self.speed = speed              # 이동 속도
        self.moved_distance = 0.0       # 누적 이동 거리
        self.total_length = path.GetLength() if path else 0.0
        self.finished = False           # 이동 완료 여부

    def update(self):
        """속도에 따라 mesh 이동"""
        if self.finished or not self.path:
            return

        self.moved_distance += self.speed
        if self.moved_distance >= self.total_length:
            self.moved_distance = self.total_length
            self.finished = True

        # 목표 위치 계산 및 이동
        target_pt = self.path.PointAtLength(self.moved_distance)
        current_center = self.original.GetBoundingBox(True).Center
        move_vec = target_pt - current_center

        moved = self.original.DuplicateMesh()
        moved.Transform(geo.Transform.Translation(move_vec))
        self.mesh = moved

# ========== jump_path 처리 (Guid → Curve 변환) ========== #
if isinstance(jump_path, System.Guid):
    sc.doc = Rhino.RhinoDoc.ActiveDoc
    obj = sc.doc.Objects.Find(jump_path)
    jump_path_curve = obj.Geometry if obj else None
    sc.doc = ghdoc
else:
    jump_path_curve = jump_path

# ========== 유효성 검사 ========== #
if jump_path_curve is None or not hasattr(jump_path_curve, "PointAtLength"):
    raise Exception("jump_path가 유효한 Curve가 아닙니다")

# ========== reset 처리 (에이전트 삭제) ========== #
if reset and 'jungha' in globals():
    del jungha

# ========== 에이전트 초기화 ========== #
if 'jungha' not in globals():
    jungha = JumpingAgent(jh, jump_path_curve, speed)  # jh: 친구 Mesh

# ========== trigger가 정수면 업데이트 실행 ========== #
if trigger % 1 == 0:
    jungha.update()

# ========== 출력 ========== #
a = jungha.mesh
b = jungha.moved_distance
# ---------- end jump ----------
